vi "Main.gvi"   [LabVIEW NXG 5.0.0]
# This template is for the Queued Message Handler design pattern. The Event Handling Loop generates messages based on user interface actions. The Message Handling Loop processes messages generated by the Event Handling Loop, or by other messages. The messages are string values, so new messages can be added easily to the Message Cases case structure in the Message Handling Loop. Each message cluster can also provide an optional value for Message Data, which is a variant that can be converted to whatever message-specific data is required.
panel controls:
  "Exit": bool
  "TEMP Button": bool
  "LUX Button": bool
  "Initialize VISA": bool
  "CMD Button": bool
  "Initialize AI": bool
  "Panel Config Button": bool
  "Set PV Angle Button": bool
  "IR Thermometer Position": bool
  "Fans Button": bool
  "Brightness Config Button": bool
  "Optic Filter Config Button": bool
  "Stop": bool
  "Panel Config Selector": string
  "PV Angle": i32
  "Fans Selector": string
  "Optic Filter Selector": string
  "IR Thermometer Position Selector": string
  "Brightness": i32
  "Command to Arduino": string = "@DO 34 0#"
  "Set LoadR": bool
  "No Load": bool
  "Set LoadRTotal": string
  "V Coeff": f64
  "C Coeff": f64
  "VAC Button": bool
  "Heat Selector": string
  "Heat Button": bool
  "Exit 2": bool
  "Do Something": bool
  "Do Something Else": bool
  "Tab": i32
  "LoadR1": string
  "LoadR10": string
  "LoadR100": string
  "LoadR1000": string
  "Measured Data": "Measured Data.gtype"
  "Receive MV": bool
  "session in": "VISA Instr"
panel indicators:
  "Display": string
  "Command reply": "ArduinoReply.gtype"
  "LUXSensor Reply": "ArduinoReply.gtype"
  "TempSensor Reply": "ArduinoReply.gtype"
  "AI measurements": waveform<f64>[]
  "Hardware Current Status": string
  "Recalculated Voltage": f64
  "Recalculated Current": f64
  "VAC Load Counter": i32
  "Voltage_Graph": f64[]
  "Current_Graph": f64[]
  "PV-Connecting Solar Panels": string
  "MV-Panel Configuration": string
  "MV-Cooling": string
  "MV-Heating": string
  "MV-Optical Filter": string
  "MV-Panel Tilt Angle": string
  "MV-Light Power": string
  "MV-LoadR1": string
  "MV-LoadR2": string
  "MV-LoadR3": string
  "MV-LoadR4": string
  "API Key": string
  "Server URL": string
  "Status of Send to SystemLink Cycle": string
  "PV-Current, mA": f64
  "SendDoubleToCloud": string
  "PV-LoadR,Ohm": f64
  "PV-Voltage, V": f64
  "PV-Temperature, ºC": f64
  "PV-LightIntensity, W/m2": f64
  "PV-Panel Tilt Angle, º": f64
  "PV-Panel Cofiguration": string
  "SendStringToCloud": string
  "PV-Cooling": string
  "PV-Heating": string
  "PV-Optical Filter": string
  "PV-LoadR1": string
  "PV-LoadR2": string
  "PV-LoadR3": string
  "PV-LoadR4": string
  "Error out Systemlink Read Cycle": error
  "Voltage MidPoint": f64
  "Current MidPoint": f64
  "Arduino Status": string
  "SendArrayDoubleToCloud": string
  "TempSensor": f64
  "LuxSensor": f64
  "LuxSensor Error": string
  "Total Set LoadR": i32
  "TempSensor Error": string
  "MV-LoadRTotal": string
  "Voltage EndPoint": f64
  "Current EndPoint": f64
  "TempSensor IR": f64
  "PV-LoadRTotal": string
  "PV-Temperature IR Position": string
  "PV-LigthPower, %": f64
  "PV-Temperature IR, ºC": f64
  "Total LoadR_SET": string
  "DATA": string
types:
  "ArduinoReply.gtype" = cluster{"Timestamp": timestamp, "DATA": string}
  "Measured Data.gtype" = cluster{"Voltage, V": f64, "Current, mA": f64, "Luminous Flux, Lux": f64, "Temperature, GradC": f64, "Temperature IR, GradC": f64}
  "UI Data.gtype" = cluster{"Boolean": bool, "String": string, "Numeric": f64}
  "ValueRange.gtype" = cluster{"maximum value": f64, "minimum value": f64}
uses:
  NI::Skyline::Configuration::Open Configuration API Key.gvi
  NI::Skyline::TagHTTP::Query Tags.gvi
  NI::Skyline::TagHTTP::Open Tag.gvi
  NI::Skyline::TagHTTP::Read Tag (String).gvi
  NI::Skyline::TagHTTP::Close Tag (Single).gvi
  NI::Skyline::Configuration::Close Configuration.gvi
  Message Queue::Create All Message Queues.gvi
  Message Queue::Enqueue Message (Single).gvi
  Support::Error Handler - Event Handling Loop.gvi
  Message Queue::Dequeue Message.gvi
  NI::VISA::Configure Serial Port (Instr).gvi
  NI::VISA::Open (Instr).gvi
  NI::DAQmx::Internal::DAQmx Create Channel (AI-Voltage-Basic).gvi
  Queued Message Handler::VISA ReadWrite.gvi
  Queued Message Handler::VISA Reply Parse.gvi
  Queued Message Handler::Panel Switch.gvi
  Queued Message Handler::VISA Multiple Write.gvi
  NI::G Core::Error::Display Error.gvi
  NI::VISA::Close (Instr).gvi
  NI::G Core::Error::Build Error Cluster.gvi
  Support::Error Handler - Message Handling Loop.gvi
  NI::Skyline::TagHTTP::Write Tag (DBL).gvi
  NI::Skyline::TagHTTP::Write Tag (String).gvi
  NI::Vision::IMAQdx::Initialize.gvi
  NI::Vision::IMAQdx::Configure Grab.gvi
  NI::Vision::Core::Basics::Create Image.gvi
  NI::Vision::IMAQdx::Grab.gvi
  NI::Vision::IMAQdx::Close.gvi
diagram:
  $"MV-Panel Configuration" <- ""
  $"MV-Cooling" <- ""
  $"MV-Heating" <- ""
  $"MV-Optical Filter" <- ""
  $"MV-Panel Tilt Angle" <- ""
  $"MV-Light Power" <- ""
  $"MV-LoadR1" <- ""
  $"MV-LoadR2" <- ""
  $"MV-LoadR3" <- ""
  $"MV-LoadR4" <- ""
  $"MV-LoadRTotal" <- ""
  # PV Config
  # 	Single
  # 	Parallel 2
  # 	Parallel 2 Diode
  # 	Series 2
  # 	Series 2 Diode
  # 	Parallel 4
  # 	Parallel 4 Diode
  # 	Series 4
  # 	Series 4 Diode
  # 	Parallel Of Series
  # 	Parallel Of Series Diode
  # 	Series Of Parallel
  # 	Series Of Parallel Diode
  # Optic Filter Config
  # 	No Filter
  # 	Filter 1
  # 	Filter 2
  # IR Thermomether
  # 	None
  # 	Panel 1
  # 	Panel 2
  # 	Panel 3
  # 	Panel 4
  # Heating/Cooling
  # 	0
  # 	50
  # 	100
  # Light Power
  # 	0 ... 100
  # Panel Tilt Angle
  # 	0 ... 120
  # Load 1
  # 	1,2,3,5;
  # Load 2
  # 	10,20.40,50;
  # Load 3
  # 	100,200,400,500;
  # Load 4
  # 	1000,2000,4000;
  w1 = ["MV-Panels Configuration", "MV-Cooling", "MV-Heating", "MV-Optical Filter", "MV-Panel Tilt Angle", "MV-Light Power", "MV-LoadR1", "MV-LoadR2", "MV-LoadR3", "MV-LoadR4", "MV-LoadRTotal"]
  Array Size(array=w1) -> (size(s)=w2)
  Initialize Array(element=1904-12-31T23:00:00Z, size=w2) -> w3
  sequence {
    frame 0 {
      Wait(time to wait=20000)
    }
  }
  s1 = w3  # shift register
  while {
    Wait(time to wait=500)
    case ($"Receive MV") {
      frame False, Default {
        w4 = s1
      }
      frame True {
        call "Open Configuration API Key.gvi"(server url=$"Server URL", api key=$"API Key") -> (configuration=w5, error out=w6)
        call "Query Tags.gvi"(paths=w1, error in=w6, configuration=w5) -> (tags=w7, error out=w8)
        Build Array(reference to "MV-Panel Configuration", reference to "MV-Cooling", reference to "MV-Heating", reference to "MV-Optical Filter", reference to "MV-Panel Tilt Angle", reference to "MV-Light Power", reference to "MV-LoadR1", reference to "MV-LoadR2", reference to "MV-LoadR3", reference to "MV-LoadR4", reference to "MV-LoadRTotal") -> w9
        for {
          w10 = each element of w7
          w11 = each element of s1
          w12 = each element of w9
          Property Node(instance in=w10) -> ("Path"=w13, "Datatype"=w14)
          call "Open Tag.gvi"(path=w13, data type=w14, error in=w8, configuration=w5) -> (tag=w15, error out=w16)
          call "Read Tag (String).gvi"(tag in=w15, error in=w16) -> (value=w17, time stamp=w18, error out=w19)
          Is Greater(x=w18, y=w11) -> w20
          case (w20) {
            frame False, Default { }
            frame True {
              Property Node(instance in=w12, "ValueSignaling"=w17)
            }
          }
          append w18 to w4
        }
        for {
          w21 = each element of w7
          call "Close Tag (Single).gvi"(tag=w21, error in=w19) -> (error out=w22)
        }
        call "Close Configuration.gvi"(configuration=w5, error in=w22) -> (error out=w23)
        $"Error out Systemlink Read Cycle" <- w23
      }
    }
    next s1 = w4
    stop if $"Exit 2"
  }
  $"PV-Connecting Solar Panels" <- ""
  disable {
    frame Enabled { }
    frame Disabled {
      Destroy User Event()
    }
  }
  w24 = bool FALSE  # Stop Event
  Create User Event[EventName="Stop Event"](user event data type=w24) -> (error out=w25, user event out=w26)
  Register For Events("Stop Event"=w26) -> (event registration refnum out=w27)
  call "Create All Message Queues.gvi"(error in=w25) -> (message queues=w28, error out=w29)
  Property Node(instance in=w28) -> ("UI"=w30)
  s2 = w27  # shift register
  while {
    event (dynamic events = s2) {
      on "Exit" Value changed {
        call "Enqueue Message (Single).gvi"(priority message=TRUE, message queue in=w30, message="Exit") -> (message queue out=w33, error out=w32)
        w31 = default
      }
      on dynamic event 0 {
        $Display <- "\"Exit\" button pressed"
        w31 = TRUE
        w32 = default
        w33 = w30
      }
      on "Window" Close? {
        call "Enqueue Message (Single).gvi"(priority message=TRUE, message queue in=w30, message="Exit") -> (message queue out=w33)
        Event Filter("Discard?"=TRUE)
        w31 = default
        w32 = default
      }
      on "Initialize VISA" Value changed {
        call "Enqueue Message (Single).gvi"(message queue in=w30, message="Initialize VISA") -> (message queue out=w33, error out=w32)
        w31 = default
      }
      on "Initialize AI" Value changed {
        call "Enqueue Message (Single).gvi"(message queue in=w30, message="Initialize AI") -> (message queue out=w33, error out=w32)
        w31 = default
      }
      on "CMD Button" Value changed {
        call "Enqueue Message (Single).gvi"(message queue in=w30, message="Send CMD") -> (message queue out=w33, error out=w32)
        w31 = default
      }
      on "TEMP Button" Value changed {
        call "Enqueue Message (Single).gvi"(message queue in=w30, message="Get Temperature") -> (message queue out=w33, error out=w32)
        w31 = default
      }
      on "LUX Button" Value changed {
        call "Enqueue Message (Single).gvi"(message queue in=w30, message="Get Brightness") -> (message queue out=w33, error out=w32)
        w31 = default
      }
      on "Panel Config Button" Value changed {
        call "Enqueue Message (Single).gvi"(message queue in=w30, message="Panel Config", message data=$"Panel Config Selector") -> (message queue out=w33, error out=w32)
        w31 = default
      }
      on "MV-Panel Configuration" Value changed {
        Event Data() -> ("New Value"=w34)
        call "Enqueue Message (Single).gvi"(message queue in=w30, message="PV Config", message data=w34) -> (message queue out=w33, error out=w32)
        w31 = default
      }
      on "Heat Button" Value changed {
        call "Enqueue Message (Single).gvi"(message queue in=w30, message="Heat Config", message data=$"Heat Selector") -> (message queue out=w33, error out=w32)
        w31 = default
      }
      on "MV-Heating" Value changed {
        Event Data() -> ("New Value"=w35)
        call "Enqueue Message (Single).gvi"(message queue in=w30, message="Heat Config", message data=w35) -> (message queue out=w33, error out=w32)
        w31 = default
      }
      on "Set PV Angle Button" Value changed {
        call "Enqueue Message (Single).gvi"(message queue in=w30, message="Set PV Angle", message data=$"PV Angle") -> (message queue out=w33, error out=w32)
        w31 = default
      }
      on "MV-Panel Tilt Angle" Value changed {
        Event Data() -> ("New Value"=w36)
        Decimal String To Number(string=w36) -> (offset past number=w37)
        call "Enqueue Message (Single).gvi"(message queue in=w30, message="Set PV Angle", message data=w37) -> (message queue out=w33, error out=w32)
        w31 = default
      }
      on "IR Thermometer Position" Value changed {
        call "Enqueue Message (Single).gvi"(message queue in=w30, message="IR Thermometer Position", message data=$"IR Thermometer Position Selector") -> (message queue out=w33, error out=w32)
        w31 = default
      }
      on "Fans Button" Value changed {
        call "Enqueue Message (Single).gvi"(message queue in=w30, message="Fans Control", message data=$"Fans Selector") -> (message queue out=w33, error out=w32)
        w31 = default
      }
      on "MV-Cooling" Value changed {
        Event Data() -> ("New Value"=w38)
        call "Enqueue Message (Single).gvi"(message queue in=w30, message="Fans Control", message data=w38) -> (message queue out=w33, error out=w32)
        w31 = default
      }
      on "Brightness Config Button" Value changed {
        call "Enqueue Message (Single).gvi"(message queue in=w30, message="Brightness Config", message data=$Brightness) -> (message queue out=w33, error out=w32)
        w31 = default
      }
      on "MV-Light Power" Value changed {
        Event Data() -> ("New Value"=w39)
        call "Enqueue Message (Single).gvi"(message queue in=w30, message="Brightness Config", message data=w39) -> (message queue out=w33, error out=w32)
        w31 = default
      }
      on "Optic Filter Config Button" Value changed {
        call "Enqueue Message (Single).gvi"(message queue in=w30, message="Optic Filter Config", message data=$"Optic Filter Selector") -> (message queue out=w33, error out=w32)
        w31 = default
      }
      on "MV-Optical Filter" Value changed {
        Event Data() -> ("New Value"=w40)
        call "Enqueue Message (Single).gvi"(message queue in=w30, message="Optic Filter Config", message data=w40) -> (message queue out=w33, error out=w32)
        w31 = default
      }
      on "Set LoadR" Value changed; "Set LoadRTotal" Value changed {
        Is Empty String Or Path(string/path=$"Set LoadRTotal") -> w41
        Concatenate Strings($LoadR1, $LoadR10, $LoadR100, $LoadR1000) -> w42
        Select(s=w41, t=w42, f=$"Set LoadRTotal") -> w43
        call "Enqueue Message (Single).gvi"(message queue in=w30, message="Set LoadR", message data=w43) -> (message queue out=w33, error out=w32)
        w31 = default
      }
      on "MV-LoadRTotal" Value changed {
        Event Data() -> ("New Value"=w44)
        call "Enqueue Message (Single).gvi"(message queue in=w30, message="Set LoadR", message data=w44) -> (message queue out=w33, error out=w32)
        w31 = default
      }
      on "No Load" Value changed {
        call "Enqueue Message (Single).gvi"(message queue in=w30, message="NoLoad") -> (message queue out=w33, error out=w32)
        w31 = default
      }
      on "VAC Button" Value changed {
        call "Enqueue Message (Single).gvi"(message queue in=w30, message="VAC", message data=0) -> (message queue out=w33, error out=w32)
        $"VAC Load Counter" <- 0
        w31 = default
      }
    }
    call "Error Handler - Event Handling Loop.gvi"(message queue in=w33, error in=w32) -> (dup error in=w45)
    stop if w31
  }
  Unregister For Events(error in=w45, event registration refnum=s2)
  $"API Key" <- "zYUbuW0YNkg1G__lXfJiGVBNWME-HlVd2a5NUHp-IP"
  w46 = cluster{"VISA Resource": "VISA Instr"} {"VISA Resource"="COM5"}
  s3 = "UI Data.gtype" {all zero or empty}  # shift register
  s4 = w46  # shift register
  while {
    call "Dequeue Message.gvi"(message queue in=w30, error in=w29) -> (message queue out=w47, message=w48, message data=w49, error out=w50)
    $"Hardware Current Status" <- w48
    # s3: Data
    # s4: VISA
    # w26: Stop Event
    case (w48) ignore case {  # Message Cases
      frame "Initialize" {
        Flush Queue(error in=w50, queue=w47) -> (error out=w55, queue out=w56)
        call "Enqueue Message (Single).gvi"(message queue in=w56, message="Initialize VISA", error in=w55) -> (message queue out=w57, error out=w58)
        call "Enqueue Message (Single).gvi"(message queue in=w57, message="Set Arduino Status", error in=w58) -> (message queue out=w59, error out=w60)
        call "Enqueue Message (Single).gvi"(message queue in=w59, message="NoLoad", error in=w60) -> (message queue out=w61, error out=w62)
        call "Enqueue Message (Single).gvi"(message queue in=w61, message="Brightness Config", message data=2, error in=w62) -> (message queue out=w63, error out=w64)
        call "Enqueue Message (Single).gvi"(message queue in=w63, message="Fans Control", message data="0", error in=w64) -> (message queue out=w65, error out=w66)
        call "Enqueue Message (Single).gvi"(message queue in=w65, message="Heat Config", message data="0", error in=w66) -> (message queue out=w67, error out=w68)
        call "Enqueue Message (Single).gvi"(message queue in=w67, message="Optic Filter Config", message data="No Filter", error in=w68) -> (message queue out=w69, error out=w70)
        call "Enqueue Message (Single).gvi"(message queue in=w69, message="IR Thermometer Position", message data="None", error in=w70) -> (message queue out=w71, error out=w72)
        call "Enqueue Message (Single).gvi"(message queue in=w71, message="Set PV Angle", message data=90, error in=w72) -> (message queue out=w73, error out=w74)
        call "Enqueue Message (Single).gvi"(message queue in=w73, message="Panel Config", message data="Parallel 4", error in=w74) -> (message queue out=w75, error out=w76)
        call "Enqueue Message (Single).gvi"(message queue in=w75, message="Wait For Event", error in=w76) -> (error out=w51)
        Build Array(reference to "Arduino Status", reference to "TempSensor Error", reference to "LuxSensor Error") -> w77
        for {
          w78 = each element of w77
          Property Node(instance in=w78, "Value"="none")
        }
        Build Array(reference to "TempSensor", reference to "LuxSensor", reference to "Recalculated Voltage", reference to "Voltage EndPoint", reference to "Voltage MidPoint", reference to "Recalculated Current", reference to "Current EndPoint", reference to "Current MidPoint", reference to "V Coeff", reference to "C Coeff") -> w79
        for {
          w80 = each element of w79
          Property Node(instance in=w80, "Value"=-1)
        }
        Property Node(instance in=reference to "Set LoadRTotal", "Value"="")
        Property Node(instance in=reference to "VAC Load Counter", "Value"=0)
        w52 = s3
        w53 = default
        w54 = s4
      }
      frame "Initialize VISA" {
        call "Configure Serial Port (Instr).gvi"(session in=$"session in", error in=w50, baud rate=115200) -> (session out=w81, error out=w82)
        call "Open (Instr).gvi"(resource name=w81, error in=w82) -> (session out=w83, error out=w51)
        Property Node(instance in=s4, "VISA Resource"=w83) -> (instance out=w54)
        Wait(time to wait=2000)
        w52 = s3
        w53 = default
      }
      frame "Initialize AI" {
        call "DAQmx Create Channel (AI-Voltage-Basic).gvi"(error in=w50, physical channels="Dev1/ai0:1,Dev1/ai3,Dev1/ai7,Dev1/ai6", units="Volts"(10348), measurement range="ValueRange.gtype" {"maximum value"=10, "minimum value"=0}, input terminal configuration="RSE"(10083)) -> (error out=w51)
        w52 = s3
        w53 = default
        w54 = default
      }
      frame "Wait For Event" {
        Wait(time to wait=100)
        call "Enqueue Message (Single).gvi"(message queue in=w47, message="Watchdog", error in=w50) -> (error out=w51)
        w52 = s3
        w53 = default
        w54 = s4
      }
      frame "Send CMD" {
        Property Node(instance in=s4) -> ("VISA Resource"=w84, instance out=w54)
        call "Enqueue Message (Single).gvi"(message queue in=w47, message="Wait For Event", error in=w50) -> (error out=w85)
        call "VISA ReadWrite.gvi"(VISA_IN=w84, CMD=$"Command to Arduino", ERROR_IN=w85) -> (Arduino_Reply=w86, ERROR_OUT=w51)
        Property Node(instance in=w86) -> ("DATA"=w87, instance out=w88)
        $"Command reply" <- w88
        $DATA <- w87
        w52 = s3
        w53 = default
      }
      frame "Set Arduino Status" {
        Property Node(instance in=s4) -> ("VISA Resource"=w89, instance out=w54)
        call "VISA ReadWrite.gvi"(VISA_IN=w89, CMD="@TIME 10 CEPHEI#", ERROR_IN=w50) -> (ERROR_OUT=w51)
        w52 = s3
        w53 = default
      }
      frame "Watchdog" {
        Property Node(instance in=s4) -> ("VISA Resource"=w90, instance out=w54)
        call "VISA ReadWrite.gvi"(VISA_IN=w90, CMD="@TIME 10 ?#", ERROR_IN=w50) -> (OUTPUT=w91, Arduino_Reply=w92, ERROR_OUT=w93)
        Property Node(instance in=w92) -> ("DATA"=w94)
        call "VISA Reply Parse.gvi"(string=w94) -> (Reply String=w95)
        Match Pattern(regular expression="CEPHEI", string=w95) -> (match substring=w96)
        Is Equal(x=w96, y="CEPHEI") -> w97
        case (w97) {
          frame False, Default {
            Flush Queue(error in=w93, queue=w47) -> (error out=w98, queue out=w99)
            call "Enqueue Message (Single).gvi"(message queue in=w99, message="Initialize", error in=w98) -> (error out=w51)
          }
          frame True {
            Array Index(array=f64[][] []) -> (out0[4, 0]=w100)
            Multiply(w100, 20) -> w101
            $"TempSensor IR" <- w101
            Array Index(array=f64[][] []) -> (out0[1, 0]=w102, out1[2, 0]=w103)
            Multiply(w102, 4) -> w104
            Multiply(w104, $"V Coeff") -> w105
            Feedback Node(input=w106) -> w107
            Build Array(w107, w105) -> w106
            $Voltage_Graph <- w106
            $"Recalculated Voltage" <- w105
            $"Voltage EndPoint" <- w102
            $"Voltage MidPoint" <- w103
            Array Index(array=f64[][] []) -> (out0[0, 0]=w108, out1[3, 0]=w109)
            Divide(x=w108, y=70) -> w110
            Multiply(w110, 1000) -> w111
            Multiply(w111, $"C Coeff") -> w112
            Feedback Node(input=w113) -> w114
            Build Array(w114, w112) -> w113
            $Current_Graph <- w113
            $"Recalculated Current" <- w112
            $"Current EndPoint" <- w108
            $"Current MidPoint" <- w109
            call "VISA ReadWrite.gvi"(VISA_IN=w91, CMD="@LUX 10 1#", ERROR_IN=w93) -> (OUTPUT=w115, Arduino_Reply=w116, ERROR_OUT=w117)
            call "VISA ReadWrite.gvi"(VISA_IN=w115, CMD="@TEMP 8 0#", ERROR_IN=w117) -> (Arduino_Reply=w118, ERROR_OUT=w119)
            call "Enqueue Message (Single).gvi"(message queue in=w47, message="Wait For Event", error in=w119) -> (error out=w51)
            $"AI measurements" <- waveform<f64>[] []
            Property Node(instance in=reference to "PV-Current, mA", "Value"=w112)
            Property Node(instance in=w116) -> ("DATA"=w120, instance out=w121)
            $"LUXSensor Reply" <- w121
            Property Node(instance in=w118) -> ("DATA"=w122, instance out=w123)
            $"TempSensor Reply" <- w123
            Property Node(instance in=reference to "PV-Voltage, V", "Value"=w105)
            call "VISA Reply Parse.gvi"(string=w120) -> (Error code=w124, Reply=w125)
            Property Node(instance in=reference to "PV-LightIntensity, W/m2", "Value"=w125)
            call "VISA Reply Parse.gvi"(string=w122) -> (Error code=w126, Reply=w127)
            Property Node(instance in=$"Measured Data", "Voltage, V"=w105, "Current, mA"=w112, "Luminous Flux, Lux"=w125, "Temperature, GradC"=w127, "Temperature IR, GradC"=w101) -> (instance out=w128)
            $"Measured Data" <- w128
            $"LuxSensor Error" <- w124
            $"TempSensor Error" <- w126
            Property Node(instance in=reference to "PV-Temperature, ºC", "Value"=w127)
            $LuxSensor <- w125
            $TempSensor <- w127
          }
        }
        $"Arduino Status" <- w95
        w52 = s3
        w53 = default
      }
      frame "Panel Config" {
        Variant To Data(error in (no error)=w50, type=string "", variant=w49) -> (data=w129, error out=w130)
        Property Node(instance in=s4) -> ("VISA Resource"=w131, instance out=w54)
        call "Panel Switch.gvi"(VISA_IN=w131, CTRL="Disconnect", ERROR_IN=w130) -> (VISA_OUT=w132, ERROR_OUT=w133)
        case (w129) {
          frame "Single" {
            w136 = ["@DO 17 0#", "@DO 18 1#", "@DO 23 1#", "@DO 24 1#", "@DO 25 1#", "@DO 26 0#", "@DO 27 0#", "@DO 28 0#", "@DO 29 1#", "@DO 30 1#", "@DO 31 1#", "@DO 32 1#", "@DO 33 0#"]
            w137 = ["@DO 54 1#", "@DO 55 1#", "@DO 56 1#", "@DO 57 1#", "@DO 58 1#", "@DO 59 1#", "@DO 60 1#", "@DO 61 1#"]
            # @DO 17 0#
            # @DO 18 1#
            # @DO 23 1#
            # @DO 24 1#
            # @DO 25 1#
            # @DO 26 0#
            # @DO 27 0#
            # @DO 28 0#
            # @DO 29 1#
            # @DO 30 1#
            # @DO 31 1#
            # @DO 32 1#
            # @DO 33 0#
            #
            # 03,08,2020
            # 19:51
            Insert Into Array(inArray=w136, new=w137) -> w138
            call "VISA Multiple Write.gvi"(VISA_IN=w132, ARRAY_IN=w138, ERROR_IN=w133) -> (ERROR_OUT=w134)
            w135 = w129
          }
          frame "Parallel 2" {
            # @DO 17 1#
            # @DO 18 0#
            # @DO 23 1#
            # @DO 24 0#
            # @DO 25 1#
            # @DO 26 1#
            # @DO 27 1#
            # @DO 28 1#
            # @DO 29 1#
            # @DO 30 1#
            # @DO 31 1#
            # @DO 32 1#
            # @DO 33 1#
            #
            # 03.08.2020
            # 19.53
            w139 = ["@DO 17 1#", "@DO 18 0#", "@DO 23 1#", "@DO 24 0#", "@DO 25 1#", "@DO 26 1#", "@DO 27 1#", "@DO 28 1#", "@DO 29 1#", "@DO 30 1#", "@DO 31 1#", "@DO 32 1#", "@DO 33 1#"]
            # Disconnect all Diodes
            w140 = ["@DO 54 1#", "@DO 55 1#", "@DO 56 1#", "@DO 57 1#", "@DO 58 1#", "@DO 59 1#", "@DO 60 1#", "@DO 61 1#"]
            Insert Into Array(inArray=w139, new=w140) -> w141
            call "VISA Multiple Write.gvi"(VISA_IN=w132, ARRAY_IN=w141, ERROR_IN=w133) -> (ERROR_OUT=w134)
            w135 = w129
          }
          frame "Parallel 2 Diode" {
            # @DO 17 1#
            # @DO 18 0#
            # @DO 23 1#
            # @DO 24 0#
            # @DO 25 1#
            # @DO 26 1#
            # @DO 27 1#
            # @DO 28 1#
            # @DO 29 1#
            # @DO 30 1#
            # @DO 31 1#
            # @DO 32 1#
            # @DO 33 1#
            #
            # 03.08.2020
            # 19.54
            w142 = ["@DO 17 1#", "@DO 18 0#", "@DO 23 1#", "@DO 24 0#", "@DO 25 1#", "@DO 26 1#", "@DO 27 1#", "@DO 28 1#", "@DO 29 1#", "@DO 30 1#", "@DO 31 1#", "@DO 32 1#", "@DO 33 1#"]
            # @DO 56 0#
            # @DO 57 0#
            #
            # 19.54
            w143 = ["@DO 54 1#", "@DO 55 1#", "@DO 56 0#", "@DO 57 0#", "@DO 58 1#", "@DO 59 1#", "@DO 60 1#", "@DO 61 1#"]
            Insert Into Array(inArray=w142, new=w143) -> w144
            call "VISA Multiple Write.gvi"(VISA_IN=w132, ARRAY_IN=w144, ERROR_IN=w133) -> (ERROR_OUT=w134)
            w135 = w129
          }
          frame "Series 2" {
            # @DO 17 0#
            # @DO 18 1#
            # @DO 23 1#
            # @DO 24 0#
            # @DO 25 1#
            # @DO 26 1#
            # @DO 27 1#
            # @DO 28 1#
            # @DO 29 0#
            # @DO 30 1#
            # @DO 31 1#
            # @DO 32 0#
            # @DO 33 0#
            #
            # 03.08.2020
            # 19.55
            w145 = ["@DO 17 0#", "@DO 18 1#", "@DO 23 1#", "@DO 24 0#", "@DO 25 1#", "@DO 26 1#", "@DO 27 1#", "@DO 28 1#", "@DO 29 0#", "@DO 30 1#", "@DO 31 1#", "@DO 32 0#", "@DO 33 0#"]
            w146 = ["@DO 54 1#", "@DO 55 1#", "@DO 56 1#", "@DO 57 1#", "@DO 58 1#", "@DO 59 1#", "@DO 60 1#", "@DO 61 1#"]
            Insert Into Array(inArray=w145, new=w146) -> w147
            call "VISA Multiple Write.gvi"(VISA_IN=w132, ARRAY_IN=w147, ERROR_IN=w133) -> (ERROR_OUT=w134)
            w135 = w129
          }
          frame "Series 2 Diode" {
            # @DO 17 0#
            # @DO 18 1#
            # @DO 23 1#
            # @DO 24 0#
            # @DO 25 1#
            # @DO 26 1#
            # @DO 27 1#
            # @DO 28 1#
            # @DO 29 0#
            # @DO 30 1#
            # @DO 31 1#
            # @DO 32 0#
            # @DO 33 0#
            #
            # 03.08.2020
            # 19.57
            w148 = ["@DO 17 0#", "@DO 18 1#", "@DO 23 1#", "@DO 24 0#", "@DO 25 1#", "@DO 26 1#", "@DO 27 1#", "@DO 28 1#", "@DO 29 0#", "@DO 30 1#", "@DO 31 1#", "@DO 32 0#", "@DO 33 0#"]
            # @DO 60 0#
            # @DO 61 0#
            #
            # 03.08.2020
            w149 = ["@DO 54 1#", "@DO 55 1#", "@DO 56 1#", "@DO 57 1#", "@DO 58 1#", "@DO 59 1#", "@DO 60 0#", "@DO 61 0#"]
            Insert Into Array(inArray=w148, new=w149) -> w150
            call "VISA Multiple Write.gvi"(VISA_IN=w132, ARRAY_IN=w150, ERROR_IN=w133) -> (ERROR_OUT=w134)
            w135 = w129
          }
          frame "Parallel 4", Default {
            # @DO 17 1#
            # @DO 18 1#
            # @DO 23 1#
            # @DO 24 1#
            # @DO 25 1#
            # @DO 26 1#
            # @DO 27 1#
            # @DO 28 1#
            # @DO 29 1#
            # @DO 30 1#
            # @DO 31 1#
            # @DO 32 1#
            # @DO 33 1#
            #
            # 03.08.2020
            # 19.59
            w151 = ["@DO 17 1#", "@DO 18 1#", "@DO 23 1#", "@DO 24 1#", "@DO 25 1#", "@DO 26 1#", "@DO 27 1#", "@DO 28 1#", "@DO 29 1#", "@DO 30 1#", "@DO 31 1#", "@DO 32 1#", "@DO 33 1#"]
            w152 = ["@DO 54 1#", "@DO 55 1#", "@DO 56 1#", "@DO 57 1#", "@DO 58 1#", "@DO 59 1#", "@DO 60 1#", "@DO 61 1#"]
            Insert Into Array(inArray=w151, new=w152) -> w153
            call "VISA Multiple Write.gvi"(VISA_IN=w132, ARRAY_IN=w153, ERROR_IN=w133) -> (ERROR_OUT=w134)
            w135 = "Parallel 4"
          }
          frame "Parallel 4 Diode" {
            # @DO 17 1#
            # @DO 18 1#
            # @DO 23 1#
            # @DO 24 1#
            # @DO 25 1#
            # @DO 26 1#
            # @DO 27 1#
            # @DO 28 1#
            # @DO 29 1#
            # @DO 30 1#
            # @DO 31 1#
            # @DO 32 1#
            # @DO 33 1#
            # 03.08.2020
            # 20.00
            w154 = ["@DO 17 1#", "@DO 18 1#", "@DO 23 1#", "@DO 24 1#", "@DO 25 1#", "@DO 26 1#", "@DO 27 1#", "@DO 28 1#", "@DO 29 1#", "@DO 30 1#", "@DO 31 1#", "@DO 32 1#", "@DO 33 1#"]
            # @DO 54 0#
            # @DO 55 0#
            # @DO 56 0#
            # @DO 57 0#
            #
            # 03.08.2020
            # 20.00
            w155 = ["@DO 54 0#", "@DO 55 0#", "@DO 56 0#", "@DO 57 0#", "@DO 58 1#", "@DO 59 1#", "@DO 60 1#", "@DO 61 1#"]
            Insert Into Array(inArray=w154, new=w155) -> w156
            call "VISA Multiple Write.gvi"(VISA_IN=w132, ARRAY_IN=w156, ERROR_IN=w133) -> (ERROR_OUT=w134)
            w135 = w129
          }
          frame "Series 4" {
            # @DO 17 0#
            # @DO 18 1#
            # @DO 23 0#
            # @DO 24 1#
            # @DO 25 1#
            # @DO 26 0#
            # @DO 27 0#
            # @DO 28 0#
            # @DO 29 0#
            # @DO 30 0#
            # @DO 31 0#
            # @DO 32 0#
            # @DO 33 0#
            #
            # 03.08.2020
            # 20.02
            w157 = ["@DO 17 0#", "@DO 18 1#", "@DO 23 0#", "@DO 24 1#", "@DO 25 1#", "@DO 26 0#", "@DO 27 0#", "@DO 28 0#", "@DO 29 0#", "@DO 30 0#", "@DO 31 0#", "@DO 32 0#", "@DO 33 0#"]
            w158 = ["@DO 54 1#", "@DO 55 1#", "@DO 56 1#", "@DO 57 1#", "@DO 58 1#", "@DO 59 1#", "@DO 60 1#", "@DO 61 1#"]
            Insert Into Array(inArray=w157, new=w158) -> w159
            call "VISA Multiple Write.gvi"(VISA_IN=w132, ARRAY_IN=w159, ERROR_IN=w133) -> (ERROR_OUT=w134)
            w135 = w129
          }
          frame "Series 4 Diode" {
            # @DO 17 0#
            # @DO 18 1#
            # @DO 23 0#
            # @DO 24 1#
            # @DO 25 1#
            # @DO 26 0#
            # @DO 27 0#
            # @DO 28 0#
            # @DO 29 0#
            # @DO 30 0#
            # @DO 31 0#
            # @DO 32 0#
            # @DO 33 0#
            #
            # 03.08.2020
            # 20.03
            w160 = ["@DO 17 0#", "@DO 18 1#", "@DO 23 0#", "@DO 24 1#", "@DO 25 1#", "@DO 26 0#", "@DO 27 0#", "@DO 28 0#", "@DO 29 0#", "@DO 30 0#", "@DO 31 0#", "@DO 32 0#", "@DO 33 0#"]
            # @DO 58 0#
            # @DO 59 0#
            # @DO 60 0#
            # @DO 61 0#
            #
            # 03.08.2020
            # 20.04
            w161 = ["@DO 54 1#", "@DO 55 1#", "@DO 56 1#", "@DO 57 1#", "@DO 58 0#", "@DO 59 0#", "@DO 60 0#", "@DO 61 0#"]
            Insert Into Array(inArray=w160, new=w161) -> w162
            call "VISA Multiple Write.gvi"(VISA_IN=w132, ARRAY_IN=w162, ERROR_IN=w133) -> (ERROR_OUT=w134)
            w135 = w129
          }
          frame "Parallel Of Series" {
            # @DO 17 1#
            # @DO 18 1#
            # @DO 23 1#
            # @DO 24 1#
            # @DO 25 1#
            # @DO 26 1#
            # @DO 27 0#
            # @DO 28 1#
            # @DO 29 0#
            # @DO 30 0#
            # @DO 31 1#
            # @DO 32 0#
            # @DO 33 1#
            #
            # 03.08.2020
            # 20.05
            w163 = ["@DO 17 1#", "@DO 18 1#", "@DO 23 1#", "@DO 24 1#", "@DO 25 1#", "@DO 26 1#", "@DO 27 0#", "@DO 28 1#", "@DO 29 0#", "@DO 30 0#", "@DO 31 1#", "@DO 32 0#", "@DO 33 1#"]
            w164 = ["@DO 54 1#", "@DO 55 1#", "@DO 56 1#", "@DO 57 1#", "@DO 58 1#", "@DO 59 1#", "@DO 60 1#", "@DO 61 1#"]
            Insert Into Array(inArray=w163, new=w164) -> w165
            call "VISA Multiple Write.gvi"(VISA_IN=w132, ARRAY_IN=w165, ERROR_IN=w133) -> (ERROR_OUT=w134)
            w135 = w129
          }
          frame "Parallel Of Series Diode" {
            # @DO 17 1#
            # @DO 18 1#
            # @DO 23 1#
            # @DO 24 1#
            # @DO 25 1#
            # @DO 26 1#
            # @DO 27 0#
            # @DO 28 1#
            # @DO 29 0#
            # @DO 30 0#
            # @DO 31 1#
            # @DO 32 0#
            # @DO 33 1#
            #
            # 03.08.2020
            # 20.06
            # @DO 58 0#
            # @DO 59 0#
            # @DO 60 0#
            # @DO 61 0#
            #
            # 03.08.2020
            # 20.097
            w166 = ["@DO 17 1#", "@DO 18 1#", "@DO 23 1#", "@DO 24 1#", "@DO 25 1#", "@DO 26 1#", "@DO 27 0#", "@DO 28 1#", "@DO 29 0#", "@DO 30 0#", "@DO 31 1#", "@DO 32 0#", "@DO 33 1#"]
            w167 = ["@DO 54 1#", "@DO 55 1#", "@DO 56 1#", "@DO 57 1#", "@DO 58 0#", "@DO 59 0#", "@DO 60 0#", "@DO 61 0#"]
            Insert Into Array(inArray=w166, new=w167) -> w168
            call "VISA Multiple Write.gvi"(VISA_IN=w132, ARRAY_IN=w168, ERROR_IN=w133) -> (ERROR_OUT=w134)
            w135 = w129
          }
          frame "Series Of Parallel" {
            w169 = ["@DO 54 1#", "@DO 55 1#", "@DO 56 1#", "@DO 57 1#", "@DO 58 1#", "@DO 59 1#", "@DO 60 1#", "@DO 61 1#"]
            # @DO 17 1#
            # @DO 18 0#
            # @DO 23 0#
            # @DO 24 0#
            # @DO 25 0#
            # @DO 26 1#
            # @DO 27 1#
            # @DO 28 1#
            # @DO 29 1#
            # @DO 30 1#
            # @DO 31 1#
            # @DO 32 1#
            # @DO 33 1#
            #
            # 03.08.2020
            # 20.07
            w170 = ["@DO 17 1#", "@DO 18 0#", "@DO 23 0#", "@DO 24 0#", "@DO 25 0#", "@DO 26 1#", "@DO 27 1#", "@DO 28 1#", "@DO 29 1#", "@DO 30 1#", "@DO 31 1#", "@DO 32 1#", "@DO 33 1#"]
            Insert Into Array(inArray=w170, new=w169) -> w171
            call "VISA Multiple Write.gvi"(VISA_IN=w132, ARRAY_IN=w171, ERROR_IN=w133) -> (ERROR_OUT=w134)
            w135 = w129
          }
          frame "Series Of Parallel Diode" {
            # @DO 17 1#
            # @DO 18 0#
            # @DO 23 0#
            # @DO 24 0#
            # @DO 25 0#
            # @DO 26 1#
            # @DO 27 1#
            # @DO 28 1#
            # @DO 29 1#
            # @DO 30 1#
            # @DO 31 1#
            # @DO 32 1#
            # @DO 33 1#
            #
            # 03.08.2020
            # 20.08
            w172 = ["@DO 17 1#", "@DO 18 0#", "@DO 23 0#", "@DO 24 0#", "@DO 25 0#", "@DO 26 1#", "@DO 27 1#", "@DO 28 1#", "@DO 29 1#", "@DO 30 1#", "@DO 31 1#", "@DO 32 1#", "@DO 33 1#"]
            # @DO 54 0#
            # @DO 55 0#
            # @DO 56 0#
            # @DO 57 0#
            #
            # 20.09
            # 03.08.2020
            w173 = ["@DO 54 0#", "@DO 55 0#", "@DO 56 0#", "@DO 57 0#", "@DO 58 1#", "@DO 59 1#", "@DO 60 1#", "@DO 61 1#"]
            Insert Into Array(inArray=w172, new=w173) -> w174
            call "VISA Multiple Write.gvi"(VISA_IN=w132, ARRAY_IN=w174, ERROR_IN=w133) -> (ERROR_OUT=w134)
            w135 = w129
          }
        }
        Property Node(instance in=reference to "PV-Panel Cofiguration", "ValueSignaling"=w135)
        call "Panel Switch.gvi"(VISA_IN=w131, CTRL="Connect", ERROR_IN=w134) -> (ERROR_OUT=w51)
        w52 = s3
        w53 = default
      }
      frame "VAC" {
        Property Node(instance in=s4) -> (instance out=w54)
        w175 = ["0", "1,", "10,", "20,10,", "50,", "50,20,", "100,", "100,40,10,", "200,100,", "500,100,", "1000,", "2000,", "2000,1000,", "4000,", "4000,1000,", "4000,2000,", "4000,2000,1000,", "4000,2000,1000,500,400,100,"]
        Variant To Data(type=i32 5, variant=w49) -> (data=w176)
        Array Size(array=w175) -> (size(s)=w177)
        Is Less Or Equal(x=$"VAC Load Counter", y=w177) -> w178
        Is Greater Or Equal(x=w176, y=i32 5) -> w179
        Logical And(w179, w178) -> w180
        case (w180) {
          frame False, Default {
            case (w178) {
              frame False, Default {
                Flush Queue(error in=w50, queue=w47) -> (error out=w182, queue out=w183)
                call "Enqueue Message (Single).gvi"(message queue in=w183, message="NoLoad", error in=w182) -> (message queue out=w184, error out=w185)
                call "Enqueue Message (Single).gvi"(message queue in=w184, message="Watchdog", error in=w185) -> (error out=w51)
                w181 = 0
              }
              frame True {
                Flush Queue(error in=w50, queue=w47) -> (error out=w186, queue out=w187)
                call "Enqueue Message (Single).gvi"(message queue in=w187, message="Watchdog", error in=w186) -> (message queue out=w188, error out=w189)
                Increment(x=w176) -> w190
                call "Enqueue Message (Single).gvi"(message queue in=w188, message="VAC", message data=w190, error in=w189) -> (error out=w51)
                w181 = $"VAC Load Counter"
              }
            }
          }
          frame True {
            Array Index(array=w175) -> (out0[$"VAC Load Counter"]=w191)
            Flush Queue(error in=w50, queue=w47) -> (error out=w192, queue out=w193)
            call "Enqueue Message (Single).gvi"(message queue in=w193, message="Set LoadR", message data=w191, error in=w192) -> (message queue out=w194, error out=w195)
            call "Enqueue Message (Single).gvi"(message queue in=w194, message="VAC", message data=0, error in=w195) -> (error out=w51)
            Increment(x=$"VAC Load Counter") -> w181
          }
        }
        $"VAC Load Counter" <- w181
        w52 = s3
        w53 = default
      }
      frame "Optic Filter Config" {
        Variant To Data(error in (no error)=w50, type=string "", variant=w49) -> (data=w196, error out=w197)
        case (w196) {
          frame "No Filter", Default {
            w198 = ["@SERV 3 20#", "@SERV 4 0#"]
            w199 = "No Filter"
          }
          frame "Filter 1" {
            w198 = ["@SERV 5 0#", "@SERV 4 0#", "@SERV 3 120#"]
            w199 = w196
          }
          frame "Filter 2" {
            w198 = ["@SERV 3 20#", "@SERV 4 0#", "@SERV 4 90#"]
            w199 = w196
          }
        }
        Property Node(instance in=reference to "PV-Optical Filter", "ValueSignaling"=w199)
        Property Node(instance in=s4) -> ("VISA Resource"=w200, instance out=w54)
        call "VISA Multiple Write.gvi"(VISA_IN=w200, ARRAY_IN=w198, ERROR_IN=w197) -> (ERROR_OUT=w51)
        w52 = s3
        w53 = default
      }
      frame "Fans Control" {
        Variant To Data(error in (no error)=w50, type=string "", variant=w49) -> (data=w201, error out=w202)
        case (w201) {
          frame "0", Default {
            w203 = ["@DO 11 0#", "@DO 12 0#"]
            w204 = "0"
          }
          frame "100" {
            w203 = ["@PWM 11 255#", "@PWM 12 255#"]
            w204 = "100"
          }
          frame "50" {
            w203 = ["@PWM 11 127#", "@PWM 12 127#"]
            w204 = "50"
          }
        }
        Property Node(instance in=reference to "PV-Cooling", "ValueSignaling"=w204)
        Property Node(instance in=s4) -> ("VISA Resource"=w205, instance out=w54)
        call "VISA Multiple Write.gvi"(VISA_IN=w205, ARRAY_IN=w203, ERROR_IN=w202) -> (ERROR_OUT=w51)
        w52 = s3
        w53 = default
      }
      frame "Heat Config" {
        Variant To Data(error in (no error)=w50, type=string "", variant=w49) -> (data=w206, error out=w207)
        case (w206) {
          frame "0", Default {
            w208 = ["@DO 9 0#"]
            w209 = "0"
          }
          frame "50" {
            w208 = ["@PWM 9 125#"]
            w209 = "50"
          }
          frame "100" {
            w208 = ["@PWM 9 255#"]
            w209 = "100"
          }
        }
        Property Node(instance in=reference to "PV-Heating", "ValueSignaling"=w209)
        Property Node(instance in=s4) -> ("VISA Resource"=w210, instance out=w54)
        call "VISA Multiple Write.gvi"(VISA_IN=w210, ARRAY_IN=w208, ERROR_IN=w207) -> (ERROR_OUT=w51)
        w52 = s3
        w53 = default
      }
      frame "Set PV Angle" {
        Variant To Data(error in (no error)=w50, type=u32 0, variant=w49) -> (data=w211, error out=w212)
        # Set angle limits for PV panels
        In Range And Coerce(lower limit=0, upper limit=180, x=w211) -> (coerced(x)=w213)
        Property Node(instance in=reference to "PV-Panel Tilt Angle, º", "ValueSignaling"=w213)
        Property Node(instance in=s4) -> ("VISA Resource"=w214, instance out=w54)
        Number To Decimal String(number=w213) -> (decimal integer string=w215)
        Concatenate Strings("@SERV 13 ", w215, "#") -> w216
        call "VISA ReadWrite.gvi"(VISA_IN=w214, CMD=w216, ERROR_IN=w212) -> (ERROR_OUT=w51)
        w52 = s3
        w53 = default
      }
      frame "Brightness Config" {
        Property Node(instance in=s4) -> ("VISA Resource"=w217, instance out=w54)
        Variant To Data(error in (no error)=w50, type=u32 0, variant=w49) -> (data=w218, error out=w219)
        # Set brightness limits
        In Range And Coerce(lower limit=2, upper limit=99, x=w218) -> (coerced(x)=w220)
        Number To Decimal String(number=w220) -> (decimal integer string=w221)
        Concatenate Strings("@DIM 6 ", w221, "#") -> w222
        call "VISA ReadWrite.gvi"(VISA_IN=w217, CMD=w222, ERROR_IN=w219) -> (ERROR_OUT=w51)
        w52 = s3
        w53 = default
      }
      frame "IR Thermometer Position" {
        Variant To Data(error in (no error)=w50, type=string "", variant=w49) -> (data=w223, error out=w224)
        case (w223) {
          frame "None", Default {
            w225 = "@SERV 5 0#"
            w226 = w223
          }
          frame "Panel 1" {
            w225 = "@SERV 5 10#"
            w226 = w223
          }
          frame "Panel 2" {
            w225 = "@SERV 5 25#"
            w226 = w223
          }
          frame "Panel 3" {
            w225 = "@SERV 5 110#"
            w226 = w223
          }
          frame "Panel 4" {
            w225 = "@SERV 5 130#"
            w226 = w223
          }
        }
        Property Node(instance in=reference to "PV-Temperature IR Position", "ValueSignaling"=w226)
        Property Node(instance in=s4) -> ("VISA Resource"=w227, instance out=w54)
        call "VISA ReadWrite.gvi"(VISA_IN=w227, CMD=w225, ERROR_IN=w224) -> (ERROR_OUT=w51)
        w52 = s3
        w53 = default
      }
      frame "Set LoadR" {
        Property Node(instance in=s4) -> ("VISA Resource"=w228, instance out=w54)
        Variant To Data(error in (no error)=w50, type=string "", variant=w49) -> (data=w229, error out=w230)
        # Disconnect ALL load
        w231 = ["@DO 42 1#", "@DO 34 0#", "@DO 35 0#", "@DO 36 0#", "@DO 37 0#", "@DO 38 0#", "@DO 39 0#", "@DO 40 0#", "@DO 41 0#", "@DO 43 0#", "@DO 44 0#", "@DO 45 0#", "@DO 46 0#", "@DO 47 0#", "@DO 48 0#", "@DO 49 0#"]
        sequence {
          frame 0 {
            call "VISA Multiple Write.gvi"(VISA_IN=w228, ARRAY_IN=w231, ERROR_IN=w230) -> (VISA_OUT=w232, ERROR_OUT=w233)
            $"Total Set LoadR" <- 1
          }
        }
        s5 = w229  # shift register
        s6 = 0  # shift register
        s7 = ""  # shift register
        while {
          Match Pattern(regular expression=",", string=s5) -> (after substring=w234, before substring=w235)
          s8 = w235  # shift register
          s9 = s6  # shift register
          while {
            Match Pattern(regular expression=",", string=s8) -> (after substring=w236, before substring=w237)
            case (w237) {
              frame "1" {
                call "VISA ReadWrite.gvi"(VISA_IN=w232, CMD="@DO 43 1#", ERROR_IN=w233) -> (ERROR_OUT=w238)
                w239 = w237
              }
              frame "2" {
                call "VISA ReadWrite.gvi"(VISA_IN=w232, CMD="@DO 44 1#", ERROR_IN=w233) -> (ERROR_OUT=w238)
                w239 = w237
              }
              frame "3" {
                call "VISA ReadWrite.gvi"(VISA_IN=w232, CMD="@DO 45 1#", ERROR_IN=w233) -> (ERROR_OUT=w238)
                w239 = w237
              }
              frame "5" {
                call "VISA ReadWrite.gvi"(VISA_IN=w232, CMD="@DO 46 1#", ERROR_IN=w233) -> (ERROR_OUT=w238)
                w239 = w237
              }
              frame "10" {
                call "VISA ReadWrite.gvi"(VISA_IN=w232, CMD="@DO 47 1#", ERROR_IN=w233) -> (ERROR_OUT=w238)
                w239 = w237
              }
              frame "20" {
                call "VISA ReadWrite.gvi"(VISA_IN=w232, CMD="@DO 48 1#", ERROR_IN=w233) -> (ERROR_OUT=w238)
                w239 = w237
              }
              frame "40" {
                call "VISA ReadWrite.gvi"(VISA_IN=w232, CMD="@DO 49 1#", ERROR_IN=w233) -> (ERROR_OUT=w238)
                w239 = w237
              }
              frame "50" {
                call "VISA ReadWrite.gvi"(VISA_IN=w232, CMD="@DO 34 1#", ERROR_IN=w233) -> (ERROR_OUT=w238)
                w239 = w237
              }
              frame "100" {
                call "VISA ReadWrite.gvi"(VISA_IN=w232, CMD="@DO 35 1#", ERROR_IN=w233) -> (ERROR_OUT=w238)
                w239 = w237
              }
              frame "200" {
                call "VISA ReadWrite.gvi"(VISA_IN=w232, CMD="@DO 36 1#", ERROR_IN=w233) -> (ERROR_OUT=w238)
                w239 = w237
              }
              frame "400" {
                call "VISA ReadWrite.gvi"(VISA_IN=w232, CMD="@DO 37 1#", ERROR_IN=w233) -> (ERROR_OUT=w238)
                w239 = w237
              }
              frame "500" {
                call "VISA ReadWrite.gvi"(VISA_IN=w232, CMD="@DO 38 1#", ERROR_IN=w233) -> (ERROR_OUT=w238)
                w239 = w237
              }
              frame "1000" {
                call "VISA ReadWrite.gvi"(VISA_IN=w232, CMD="@DO 39 1#", ERROR_IN=w233) -> (ERROR_OUT=w238)
                w239 = w237
              }
              frame "2000" {
                call "VISA ReadWrite.gvi"(VISA_IN=w232, CMD="@DO 40 1#", ERROR_IN=w233) -> (ERROR_OUT=w238)
                w239 = w237
              }
              frame "4000" {
                call "VISA ReadWrite.gvi"(VISA_IN=w232, CMD="@DO 41 1#", ERROR_IN=w233) -> (ERROR_OUT=w238)
                w239 = w237
              }
              frame "0", Default {
                # Short Circut
                # Схема сопротивления
                # 1 Ом + 1 Ом токовый резистор
                w238 = w233
                w239 = "Short Circuit (<1 Ohm)"
              }
            }
            Decimal String To Number(string=w239) -> (number=w240)
            Add(w240, s9) -> w241
            $"Total Set LoadR" <- w241
            Concatenate Strings(s7, ",", w239) -> w242
            $"Total LoadR_SET" <- w242
            Is Empty String Or Path(string/path=w236) -> w243
            next s8 = w236
            next s9 = w241
            stop if w243
          }
          Is Empty String Or Path(string/path=w234) -> w244
          next s5 = w234
          next s6 = s9
          next s7 = w242
          stop if w244
        }
        # Connect Load
        call "VISA ReadWrite.gvi"(VISA_IN=w228, CMD="@DO 42 0#", ERROR_IN=w238) -> (ERROR_OUT=w51)
        $"Total Set LoadR" <- s6
        Property Node(instance in=reference to "PV-LoadR,Ohm", "ValueSignaling"=s6)
        $"Total LoadR_SET" <- s7
        Property Node(instance in=reference to "PV-LoadRTotal", "ValueSignaling"=s7)
        w52 = s3
        w53 = default
      }
      frame "NoLoad" {
        # Сопротивление в начальное положение
        Property Node(instance in=reference to "PV-LoadRTotal", "ValueSignaling"="Disconnected (NO LOAD)")
        Property Node(instance in=reference to "Set LoadRTotal", "Value"="")
        $"Total LoadR_SET" <- "Disconnected (NO LOAD)"
        Property Node(instance in=reference to "PV-LoadR,Ohm", "ValueSignaling"=-1)
        $"Total Set LoadR" <- -1
        Property Node(instance in=s4) -> ("VISA Resource"=w245, instance out=w54)
        # Disconnect all Load adn breake circuit
        # NO LOAD
        # Размыкаются всё реле, сопротивление- бесконечность
        w246 = ["@DO 42 1#", "@DO 34 1#", "@DO 35 1#", "@DO 36 1#", "@DO 37 1#", "@DO 38 1#", "@DO 39 1#", "@DO 40 1#", "@DO 41 1#", "@DO 43 1#", "@DO 44 1#", "@DO 45 1#", "@DO 46 1#", "@DO 47 1#", "@DO 48 1#", "@DO 49 1#"]
        call "VISA Multiple Write.gvi"(VISA_IN=w245, ARRAY_IN=w246, ERROR_IN=w50) -> (ERROR_OUT=w51)
        w52 = s3
        w53 = default
      }
      frame "Error" {
        Variant To Data(error in (no error)=w50, type=no error, variant=w49) -> (data=w247, error out=w51)
        # #CodeRecommended - If you ever change the name of this "Error" message, you'll need to update the name in the Check Loop Error.vi as well.
        call "Display Error.gvi"(error in=w247)
        w52 = s3
        w53 = default
        w54 = s4
      }
      frame "Exit" {
        Generate User Event(event data=TRUE, user event=w26) -> (error out=w248)
        Release Queue(error in=w50, queue=w47) -> (error out=w249)
        Property Node(instance in=s4) -> ("VISA Resource"=w250)
        call "Close (Instr).gvi"(session in=w250) -> (error out=w251)
        Merge Errors(w251, w248, w249) -> (error out=w51)
        w52 = s3
        w53 = TRUE
        w54 = default
      }
      frame Default {
        w252 = "The invalid message string \"%s\" was received in the Message Handling Loop."
        Format Into String(formatString=w252, w48) -> w253
        call "Build Error Cluster.gvi"(code=1, description=w253) -> (error out=w51)
        w52 = s3
        w53 = default
        w54 = s4
      }
    }
    call "Error Handler - Message Handling Loop.gvi"(message queue in=w47, error in=w51) -> (dup error in=w254)
    next s3 = w52
    next s4 = w54
    stop if w53
  }
  $"Server URL" <- "https://api.systemlinkcloud.com/"
  $"Exit 2" <- FALSE
  $SendArrayDoubleToCloud <- "Send Measured Data To Cloud"
  $SendStringToCloud <- "Send String To Cloud"
  $SendDoubleToCloud <- "Send Double To Cloud"
  w255 = bool FALSE  # Stop Event
  Create User Event[EventName="Stop Event"](user event data type=w255) -> (error out=w256, user event out=w257)
  call "Create All Message Queues.gvi"(error in=w256) -> (message queues=w258, error out=w259)
  Property Node(instance in=w258) -> ("UI"=w260)
  s10 = "UI Data.gtype" {all zero or empty}  # shift register
  while {
    call "Dequeue Message.gvi"(message queue in=w260, error in=w259) -> (message queue out=w261, message=w262, message data=w263, error out=w264)
    # s10: Data
    # w257: Stop Event
    case (w262) ignore case {  # Message Cases
      frame "Initialize" {
        Property Node(instance in=s10, "String"=w262) -> (instance out=w266)
        call "Enqueue Message (Single).gvi"(message queue in=w261, message="Update Display", message data=w262, error in=w264) -> (message queue out=w268, error out=w269)
        # Bundle a sample string value.
        call "Enqueue Message (Single).gvi"(message queue in=w268, message=$SendArrayDoubleToCloud, error in=w269) -> (error out=w265)
        Property Node(instance in=reference to "PV-Temperature, ºC", "ValueSignaling"=0)
        Property Node(instance in=reference to "MV-Panel Configuration", "Value"="none")
        Property Node(instance in=reference to "PV-Panel Cofiguration", "ValueSignaling"="none")
        Property Node(instance in=reference to "MV-Heating", "Value"="none")
        Property Node(instance in=reference to "PV-Temperature IR, ºC", "ValueSignaling"=0)
        Property Node(instance in=reference to "PV-Heating", "ValueSignaling"="none")
        Property Node(instance in=reference to "MV-Cooling", "Value"="none")
        Property Node(instance in=reference to "PV-LightIntensity, W/m2", "ValueSignaling"=0)
        Property Node(instance in=reference to "PV-Cooling", "ValueSignaling"="none")
        Property Node(instance in=reference to "MV-Light Power", "Value"="none")
        Property Node(instance in=reference to "PV-Panel Tilt Angle, º", "ValueSignaling"=0)
        Property Node(instance in=reference to "PV-Optical Filter", "ValueSignaling"="none")
        Property Node(instance in=reference to "MV-Optical Filter", "Value"="none")
        Property Node(instance in=reference to "PV-LigthPower, %", "ValueSignaling"=0)
        Property Node(instance in=reference to "PV-LoadR4", "ValueSignaling"="none")
        Property Node(instance in=reference to "MV-Panel Tilt Angle", "Value"="none")
        Property Node(instance in=reference to "PV-Voltage, V", "ValueSignaling"=0)
        Property Node(instance in=reference to "PV-LoadR3", "ValueSignaling"="none")
        Property Node(instance in=reference to "MV-LoadR1", "Value"="none")
        Property Node(instance in=reference to "PV-LoadR2", "ValueSignaling"="none")
        Property Node(instance in=reference to "PV-Current, mA", "ValueSignaling"=0)
        Property Node(instance in=reference to "MV-LoadR2", "Value"="none")
        Property Node(instance in=reference to "PV-LoadR1", "ValueSignaling"="none")
        Property Node(instance in=reference to "PV-LoadR,Ohm", "ValueSignaling"=0)
        Property Node(instance in=reference to "MV-LoadR3", "Value"="none")
        Property Node(instance in=reference to "PV-LoadRTotal", "ValueSignaling"="none")
        Property Node(instance in=reference to "MV-LoadR4", "Value"="none")
        Property Node(instance in=reference to "MV-LoadRTotal", "Value"="none")
        w267 = default
      }
      frame "Something" {
        # #CodeNeeded - Perform whatever actions correspond to the "Something" message.
        # Send string to "Update Display" message
        call "Enqueue Message (Single).gvi"(message queue in=w261, message="Update Display", message data="\"Do Something\" button pressed", error in=w264) -> (error out=w265)
        w266 = s10
        w267 = default
      }
      frame "Something Else" {
        # #CodeNeeded - Perform whatever actions correspond to the "Something Else" message.
        # Send string to "Update Display" message
        call "Enqueue Message (Single).gvi"(message queue in=w261, message="Update Display", message data="\"Do Something Else\" button pressed", error in=w264) -> (error out=w265)
        w266 = s10
        w267 = default
      }
      frame "Update Display" {
        # #CodeRecommended - If you wish to decouple the Message Handling Loop from your user interface, consider creating User Events (like the "Stop" event in this VI) to message the Event Handling Loop whenever the user interface needs updating.
        Variant To Data(error in (no error)=w264, type=string "", variant=w263) -> (data=w270, error out=w265)
        $"Status of Send to SystemLink Cycle" <- w270
        w266 = s10
        w267 = default
      }
      frame "Error" {
        Variant To Data(error in (no error)=w264, type=no error, variant=w263) -> (data=w271, error out=w265)
        # #CodeRecommended - Consider creating a system for logging errors in some way. These errors are for notification purposes only. Handling of specific errors should be performed in the message frames that generated the error.
        # #CodeRecommended - If you ever change the name of this "Error" message, you'll need to update the name in the Check Loop Error.vi as well.
        call "Display Error.gvi"(error in=w271)
        w266 = s10
        w267 = default
      }
      frame "---Copy This Frame---" {
        Merge Errors(w264) -> (error out=w265)
        w266 = s10
        w267 = default
      }
      frame "Exit" {
        # Release the message queue reference
        Release Queue(error in=w264, queue=w261) -> (error out=w272)
        # #CodeNeeded - Add any required cleanup code here. Note that if 'Exit' was called as a result of an error, an error dialog will be displayed. Add any custom error handling for an 'Exit' condition here as well.
        Generate User Event(event data=TRUE, user event=w257) -> (error out=w273)
        Merge Errors(w273, w272) -> (error out=w265)
        # Stop the VI
        $"Exit 2" <- TRUE
        w266 = s10
        w267 = TRUE
      }
      frame Default {
        w274 = "The invalid message string \"%s\" was received in the Message Handling Loop."
        Format Into String(formatString=w274, w262) -> w275
        call "Build Error Cluster.gvi"(code=1, description=w275) -> (error out=w265)
        w266 = s10
        w267 = default
      }
      frame "Send Double To Cloud" {
        Property Node(instance in=s10, "String"=w262) -> (instance out=w266)
        call "Open Configuration API Key.gvi"(server url=$"Server URL", api key=$"API Key", error in=w264) -> (configuration=w276)
        Variant To Data(type=string[] [], variant=w263) -> (data=w277)
        Array Index(array=w277) -> (out0[0]=w278, out1[1]=w279)
        Floating Point String To Number(string=w279) -> (number=w280)
        Build Array(w278) -> w281
        call "Query Tags.gvi"(paths=w281, configuration=w276) -> (tags=w282, error out=w283)
        Array Index(array=w282) -> (out0[_]=w284)
        Property Node(instance in=w284) -> ("Path"=w285, "Datatype"=w286)
        call "Open Tag.gvi"(path=w285, data type=w286, error in=w283, configuration=w276) -> (tag=w287, error out=w288)
        call "Write Tag (DBL).gvi"(tag in=w287, value=w280, error in=w288) -> (tag out=w289, error out=w290)
        call "Close Tag (Single).gvi"(tag=w289, error in=w290) -> (error out=w291)
        call "Close Configuration.gvi"(configuration=w276, error in=w291) -> (error out=w265)
        call "Enqueue Message (Single).gvi"(message queue in=w261, message="Update Display", message data=w262)
        w267 = default
      }
      frame "Send Measured Data To Cloud" {
        Property Node(instance in=s10, "String"=w262) -> (instance out=w266)
        call "Enqueue Message (Single).gvi"(message queue in=w261, message="Update Display", message data=w262, error in=w264) -> (message queue out=w292, error out=w293)
        call "Enqueue Message (Single).gvi"(message queue in=w292, message=$SendArrayDoubleToCloud, error in=w293) -> (error out=w294)
        call "Open Configuration API Key.gvi"(server url=$"Server URL", api key=$"API Key", error in=w294) -> (configuration=w295, error out=w296)
        w297 = ["PV-Current", "PV-Voltage", "PV-LigthtIntensity", "PV-Temperature"]
        call "Query Tags.gvi"(paths=w297, error in=w296, configuration=w295) -> (tags=w298, error out=w299)
        Property Node(instance in=$"Measured Data") -> ("Voltage, V"=w300, "Current, mA"=w301, "Luminous Flux, Lux"=w302, "Temperature, GradC"=w303)
        Build Array(w300, w301, w302, w303) -> w304
        for {
          w305 = each element of w298
          w306 = each element of w304
          Property Node(instance in=w305) -> ("Path"=w307, "Datatype"=w308)
          call "Open Tag.gvi"(path=w307, data type=w308, error in=w299, configuration=w295) -> (tag=w309, error out=w310)
          call "Write Tag (DBL).gvi"(tag in=w309, value=w306, error in=w310) -> (error out=w311)
        }
        for {
          w312 = each element of w298
          call "Close Tag (Single).gvi"(tag=w312, error in=w311) -> (error out=w313)
        }
        call "Close Configuration.gvi"(configuration=w295, error in=w313) -> (error out=w265)
        w267 = default
      }
      frame "Send String To Cloud" {
        Property Node(instance in=s10, "String"=w262) -> (instance out=w266)
        call "Open Configuration API Key.gvi"(server url=$"Server URL", api key=$"API Key", error in=w264) -> (configuration=w314, error out=w315)
        Variant To Data(type=string[] [], variant=w263) -> (data=w316)
        Array Index(array=w316) -> (out0[0]=w317, out1[1]=w318)
        Build Array(w317) -> w319
        call "Query Tags.gvi"(paths=w319, configuration=w314) -> (tags=w320)
        Array Index(array=w320) -> (out0[_]=w321)
        Property Node(instance in=w321) -> ("Path"=w322, "Datatype"=w323)
        call "Open Tag.gvi"(path=w322, data type=w323, error in=w315, configuration=w314) -> (tag=w324, error out=w325)
        call "Write Tag (String).gvi"(tag in=w324, value=w318, error in=w325) -> (tag out=w326, error out=w327)
        call "Close Tag (Single).gvi"(tag=w326, error in=w327) -> (error out=w328)
        call "Close Configuration.gvi"(configuration=w314, error in=w328) -> (error out=w265)
        call "Enqueue Message (Single).gvi"(message queue in=w261, message="Update Display", message data=w262)
        w267 = default
      }
    }
    call "Error Handler - Message Handling Loop.gvi"(message queue in=w261, error in=w265) -> (dup error in=w329)
    next s10 = w266
    stop if w267
  }
  Register For Events("Stop Event"=w257) -> (event registration refnum out=w330)
  s11 = w330  # shift register
  while {
    event (dynamic events = s11) {
      on "Do Something" Value changed {
        # #CodeNeeded - Send the appropriate message for this user interface event.
        call "Enqueue Message (Single).gvi"(message queue in=w260, message="Something") -> (message queue out=w333, error out=w332)
        w331 = default
      }
      on "Do Something Else" Value changed {
        # #CodeNeeded - Send the appropriate message for this user interface event.
        call "Enqueue Message (Single).gvi"(message queue in=w260, message="Something Else") -> (message queue out=w333, error out=w332)
        w331 = default
      }
      on "Exit" Value changed {
        call "Enqueue Message (Single).gvi"(priority message=TRUE, message queue in=w260, message="Exit") -> (message queue out=w333, error out=w332)
        w331 = default
      }
      on dynamic event 0 {
        # The Message Handling Loop processed an "Exit" message, which fired this event to stop the Event Handling Loop.
        $"Status of Send to SystemLink Cycle" <- "\"Exit\" button pressed"
        w331 = TRUE
        w332 = default
        w333 = w260
      }
      on "Window" Close? {
        call "Enqueue Message (Single).gvi"(priority message=TRUE, message queue in=w260, message="Exit") -> (message queue out=w333)
        Event Filter("Discard?"=TRUE)
        w331 = default
        w332 = default
      }
      on "PV-Current, mA" Value changed {
        Event Data() -> ("New Value"=w334)
        Number To Fractional String(number=w334) -> (F-format string=w335)
        Build Array("PV-Current", w335) -> w336
        call "Enqueue Message (Single).gvi"(message queue in=w260, message=$SendDoubleToCloud, message data=w336) -> (message queue out=w333, error out=w332)
        w331 = default
      }
      on "PV-LoadR,Ohm" Value changed {
        Event Data() -> ("New Value"=w337)
        Number To Fractional String(number=w337) -> (F-format string=w338)
        Build Array("PV-LoadR", w338) -> w339
        call "Enqueue Message (Single).gvi"(message queue in=w260, message=$SendDoubleToCloud, message data=w339) -> (message queue out=w333, error out=w332)
        w331 = default
      }
      on "PV-Voltage, V" Value changed {
        Event Data() -> ("New Value"=w340)
        Number To Fractional String(number=w340) -> (F-format string=w341)
        Build Array("PV-Voltage", w341) -> w342
        call "Enqueue Message (Single).gvi"(message queue in=w260, message=$SendDoubleToCloud, message data=w342) -> (message queue out=w333, error out=w332)
        w331 = default
      }
      on "PV-Temperature, ºC" Value changed {
        Event Data() -> ("New Value"=w343)
        Number To Fractional String(number=w343) -> (F-format string=w344)
        Build Array("PV-Temperature", w344) -> w345
        call "Enqueue Message (Single).gvi"(message queue in=w260, message=$SendDoubleToCloud, message data=w345) -> (message queue out=w333, error out=w332)
        w331 = default
      }
      on "PV-Temperature IR, ºC" Value changed {
        Event Data() -> ("New Value"=w346)
        Number To Fractional String(number=w346) -> (F-format string=w347)
        Build Array("PV-Temperature IR", w347) -> w348
        call "Enqueue Message (Single).gvi"(message queue in=w260, message=$SendDoubleToCloud, message data=w348) -> (message queue out=w333, error out=w332)
        w331 = default
      }
      on "PV-LightIntensity, W/m2" Value changed {
        Event Data() -> ("New Value"=w349)
        Number To Fractional String(number=w349) -> (F-format string=w350)
        Build Array("PV-LigthtIntensity", w350) -> w351
        call "Enqueue Message (Single).gvi"(message queue in=w260, message=$SendDoubleToCloud, message data=w351) -> (message queue out=w333, error out=w332)
        w331 = default
      }
      on "PV-LigthPower, %" Value changed {
        Event Data() -> ("New Value"=w352)
        Number To Fractional String(number=w352) -> (F-format string=w353)
        Build Array("PV-LigthtPower", w353) -> w354
        call "Enqueue Message (Single).gvi"(message queue in=w260, message=$SendDoubleToCloud, message data=w354) -> (message queue out=w333, error out=w332)
        w331 = default
      }
      on "PV-Panel Tilt Angle, º" Value changed {
        Event Data() -> ("New Value"=w355)
        Number To Fractional String(number=w355) -> (F-format string=w356)
        Build Array("PV-Panel Tilt Angle", w356) -> w357
        call "Enqueue Message (Single).gvi"(message queue in=w260, message=$SendDoubleToCloud, message data=w357) -> (message queue out=w333, error out=w332)
        w331 = default
      }
      on "PV-Panel Cofiguration" Value changed {
        Event Data() -> ("New Value"=w358)
        Build Array("PV-Panel Configuration", w358) -> w359
        call "Enqueue Message (Single).gvi"(message queue in=w260, message=$SendStringToCloud, message data=w359) -> (message queue out=w333, error out=w332)
        w331 = default
      }
      on "PV-Temperature IR Position" Value changed {
        Event Data() -> ("New Value"=w360)
        Build Array("PV-Temperature IR Position", w360) -> w361
        call "Enqueue Message (Single).gvi"(message queue in=w260, message=$SendStringToCloud, message data=w361) -> (message queue out=w333, error out=w332)
        w331 = default
      }
      on "PV-Cooling" Value changed {
        Event Data() -> ("New Value"=w362)
        Build Array("PV-Cooling", w362) -> w363
        call "Enqueue Message (Single).gvi"(message queue in=w260, message=$SendStringToCloud, message data=w363) -> (message queue out=w333, error out=w332)
        w331 = default
      }
      on "PV-Heating" Value changed {
        Event Data() -> ("New Value"=w364)
        Build Array("PV-Heating", w364) -> w365
        call "Enqueue Message (Single).gvi"(message queue in=w260, message=$SendStringToCloud, message data=w365) -> (message queue out=w333, error out=w332)
        w331 = default
      }
      on "PV-Optical Filter" Value changed {
        Event Data() -> ("New Value"=w366)
        Build Array("PV-Optical Filter", w366) -> w367
        call "Enqueue Message (Single).gvi"(message queue in=w260, message=$SendStringToCloud, message data=w367) -> (message queue out=w333, error out=w332)
        w331 = default
      }
      on "PV-LoadR1" Value changed {
        Event Data() -> ("New Value"=w368)
        Build Array("PV-LoadR1", w368) -> w369
        call "Enqueue Message (Single).gvi"(message queue in=w260, message=$SendStringToCloud, message data=w369) -> (message queue out=w333)
        w331 = default
        w332 = default
      }
      on "PV-LoadR2" Value changed {
        Event Data() -> ("New Value"=w370)
        Build Array("PV-LoadR2", w370) -> w371
        call "Enqueue Message (Single).gvi"(message queue in=w260, message=$SendStringToCloud, message data=w371) -> (message queue out=w333)
        w331 = default
        w332 = default
      }
      on "PV-LoadR3" Value changed {
        Event Data() -> ("New Value"=w372)
        Build Array("PV-LoadR3", w372) -> w373
        call "Enqueue Message (Single).gvi"(message queue in=w260, message=$SendStringToCloud, message data=w373) -> (message queue out=w333)
        w331 = default
        w332 = default
      }
      on "PV-LoadR4" Value changed {
        Event Data() -> ("New Value"=w374)
        Build Array("PV-LoadR4", w374) -> w375
        call "Enqueue Message (Single).gvi"(message queue in=w260, message=$SendStringToCloud, message data=w375) -> (message queue out=w333)
        w331 = default
        w332 = default
      }
      on "PV-LoadRTotal" Value changed {
        Event Data() -> ("New Value"=w376)
        Build Array("PV-LoadRTotal", w376) -> w377
        call "Enqueue Message (Single).gvi"(message queue in=w260, message=$SendStringToCloud, message data=w377) -> (message queue out=w333)
        w331 = default
        w332 = default
      }
    }
    call "Error Handler - Event Handling Loop.gvi"(message queue in=w333, error in=w332) -> (dup error in=w378)
    stop if w331
  }
  Unregister For Events(error in=w378, event registration refnum=s11) -> (error out=w379)
  Merge Errors(w379, w329) -> (error out=w380)
  Destroy User Event(error in=w380, user event=w257)
  disable {
    frame Enabled { }
    frame Disabled {
      call "Initialize.gvi"(device name="cam0") -> (session out=w381, error out=w382)
      call "Configure Grab.gvi"(session in=w381, error in=w382) -> (session out=w383, error out=w384)
      call "Create Image.gvi"(image name="image_1") -> (new image=w385)
      while {
        call "Grab.gvi"(session in=w383, error in=w384, image in=w385) -> (session out=w386, error out=w387)
        stop if $Stop
      }
      call "Close.gvi"(session=w386, error in=w387)
    }
  }
