vi "Main.gvi"   [LabVIEW NXG 5.0.0]
# This template is for the Queued Message Handler design pattern.
# The Event Handling Loop generates messages based on user interface actions.
# The Message Handling Loop processes messages generated by the Event Handling Loop, or by other messages.  The messages are string values, so new messages can be added easily to the Message Cases case structure in the Message Handling Loop.  Each message cluster can also provide an optional value for Message Data, which is a variant that can be converted to whatever message-specific data is required.
panel controls:
  "Exit": bool
  "TEMP Button": bool
  "LUX Button": bool
  "VISA Resource Name": "VISA Instr" = "COM5"
  "Initialize VISA": bool
  "CMD Button": bool
  "Initialize AI": bool
  "PV Config Button": bool
  "Set PV Angle Button": bool
  "IR Thermometer Config Button": bool
  "Fans Button": bool
  "Brightness Config Button": bool
  "Optic Filter Config Button": bool
  "Reset CVM Button": bool
  "Stop": bool
  "PV Config Selector": string
  "PV Angle": i32
  "Fans Selector": string
  "Optic Filter Selector": string
  "IR Thermometer Selector": string
  "Brightness": i32
  "Prepare CVM Button": bool
  "write buffer": string = "@DO 34 0#"
  "Set Resistance Button": bool
  "Reset Resistance Button": bool
  "Resistance String": string
  "VAC Button": bool
  "Heat Selector": string
  "Heat Button": bool
panel indicators:
  "Display": string
  "CMD": "TAG.gtype"
  "LUX_2": "TAG.gtype"
  "TEMP_2": "TAG.gtype"
  "Chart": waveform<f64>[]
  "Maсhine State": string
  "Image": "Vision IMAQImage"
  "Voltage Range": f64
  "Voltage coeff": f64
  "Current coeff": f64
  "V_real": f64
  "Current_real": f64
  "VAC Load Counter": i32
  "Voltage_Graph": f64[]
  "Output": error
  "VISA Answer_2": "TAG.gtype"[]
  "VISA Answer": "TAG.gtype"[]
  "Current_Graph": f64[]
  "Graph_3": cluster{"Element 1": f64[], "Element 2": f64[]}
  "Server Url": string
  "Api Key": string
  "Status PV Config": string
  "PV-Connecting Solar Panels": string
  "CMD TIME": "TAG.gtype"
types:
  "TAG.gtype" = cluster{"Timestamp": timestamp, "DATA": string}
  "DataType.gtype" = enum{"Double", "I32", "String", "Boolean", "U64", "Timestamp"}
  "Tag.gtype" = cluster{"Path": string, "Datatype": "DataType.gtype", "Configuration": "Configuration.gtype"}
  "Client Handle.gtype" = u32
  "Configuration.gtype" = cluster{"Server URL": string, "Session": "Client Handle.gtype", "Raw Session Queue": Queue<"Client Handle.gtype">}
  T1 = cluster{"VISA Resource": "VISA Instr", "Physical Channel": "DAQmx Task", "tag": "Tag.gtype", "configuration": "Configuration.gtype"}
  "UI Data.gtype" = cluster{"Boolean <Replace Me>": bool, "String <Replace Me>": string, "Numeric <Replace Me>": f64}
  "ValueRange.gtype" = cluster{"maximum value": f64, "minimum value": f64}
uses:
  Message Queue::Create All Message Queues.gvi
  Message Queue::Enqueue Message (Single).gvi
  Support::Error Handler - Event Handling Loop.gvi
  Message Queue::Dequeue Message.gvi
  NI::VISA::Configure Serial Port (Instr).gvi
  NI::VISA::Open (Instr).gvi
  NI::Skyline::Configuration::Open Configuration API Key.gvi
  NI::Skyline::TagHTTP::Open Tag.gvi
  NI::DAQmx::Internal::DAQmx Create Channel (AI-Voltage-Basic).gvi
  Queued Message Handler::Read_Write_VISA.gvi
  Queued Message Handler::PV_switch.gvi
  Queued Message Handler::CMD_Iteration.gvi
  NI::DAQmx::Internal::DAQmx Read (Analog 2D DBL NChan NSamp).gvi
  NI::DAQmx::Internal::DAQmx Read (Analog 1D Wfm NChan NSamp).gvi
  NI::G Core::Error::Display Error.gvi
  NI::Skyline::Configuration::Close Configuration.gvi
  NI::Skyline::TagHTTP::Close Tag (Single).gvi
  NI::DAQmx::Internal::DAQmx Stop Task.gvi
  NI::VISA::Close (Instr).gvi
  NI::G Core::Error::Build Error Cluster.gvi
  Support::Error Handler - Message Handling Loop.gvi
  NI::Vision::IMAQdx::Initialize.gvi
  NI::Vision::IMAQdx::Configure Grab.gvi
  NI::Vision::Core::Basics::Create Image.gvi
  NI::Vision::IMAQdx::Grab.gvi
  NI::Vision::IMAQdx::Close.gvi
diagram:
  $"Server Url" <- "https://api.systemlinkcloud.com/"
  $"PV-Connecting Solar Panels" <- ""
  $"Api Key" <- "zYUbuW0YNkg1G__lXfJiGVBNWME-HlVd2a5NUHp-IP"
  disable {
    frame Enabled { }
    frame Disabled {
      Destroy User Event()
    }
  }
  w1 = bool FALSE  # Stop Event
  Create User Event[EventName="Stop Event"](user event data type=w1) -> (error out=w2, user event out=w3)
  Register For Events("Stop Event"=w3) -> (event registration refnum out=w4)
  call "Create All Message Queues.gvi"(error in=w2) -> (message queues=w5, error out=w6)
  Property Node(instance in=w5) -> ("UI"=w7)
  s1 = w4  # shift register
  while {
    event (dynamic events = s1) {
      on "TEMP Button" Value changed {
        call "Enqueue Message (Single).gvi"(message queue in=w7, message="Get Temperature") -> (message queue out=w10, error out=w9)
        w8 = default
      }
      on "LUX Button" Value changed {
        call "Enqueue Message (Single).gvi"(message queue in=w7, message="Get Brightness") -> (message queue out=w10, error out=w9)
        w8 = default
      }
      on "Exit" Value changed {
        call "Enqueue Message (Single).gvi"(priority message=TRUE, message queue in=w7, message="Exit") -> (message queue out=w10, error out=w9)
        w8 = default
      }
      on dynamic event 0 {
        $Display <- "\"Exit\" button pressed"
        w8 = TRUE
        w9 = default
        w10 = w7
      }
      on "Window" Close? {
        call "Enqueue Message (Single).gvi"(priority message=TRUE, message queue in=w7, message="Exit") -> (message queue out=w10)
        Event Filter("Discard?"=TRUE)
        w8 = default
        w9 = default
      }
      on "Initialize VISA" Value changed {
        call "Enqueue Message (Single).gvi"(message queue in=w7, message="Initialize VISA") -> (message queue out=w10, error out=w9)
        w8 = default
      }
      on "CMD Button" Value changed {
        call "Enqueue Message (Single).gvi"(message queue in=w7, message="Send CMD") -> (message queue out=w10, error out=w9)
        w8 = default
      }
      on "Reset CVM Button" Value changed {
        call "Enqueue Message (Single).gvi"(message queue in=w7, message="Reset CVM") -> (message queue out=w10, error out=w9)
        w8 = default
      }
      on "Initialize AI" Value changed {
        call "Enqueue Message (Single).gvi"(message queue in=w7, message="Initialize AI") -> (message queue out=w10, error out=w9)
        w8 = default
      }
      on "PV Config Button" Value changed {
        call "Enqueue Message (Single).gvi"(message queue in=w7, message="PV Config", message data=$"PV Config Selector") -> (message queue out=w10, error out=w9)
        w8 = default
      }
      on "Heat Button" Value changed {
        call "Enqueue Message (Single).gvi"(message queue in=w7, message="Heat Config", message data=$"Heat Selector") -> (message queue out=w10, error out=w9)
        w8 = default
      }
      on "Set PV Angle Button" Value changed {
        call "Enqueue Message (Single).gvi"(message queue in=w7, message="Set PV Angle", message data=$"PV Angle") -> (message queue out=w10, error out=w9)
        w8 = default
      }
      on "IR Thermometer Config Button" Value changed {
        call "Enqueue Message (Single).gvi"(message queue in=w7, message="IR Thermometer", message data=$"IR Thermometer Selector") -> (message queue out=w10, error out=w9)
        w8 = default
      }
      on "Fans Button" Value changed {
        call "Enqueue Message (Single).gvi"(message queue in=w7, message="Fans Control", message data=$"Fans Selector") -> (message queue out=w10, error out=w9)
        w8 = default
      }
      on "Brightness Config Button" Value changed {
        call "Enqueue Message (Single).gvi"(message queue in=w7, message="Brightness Config", message data=$Brightness) -> (message queue out=w10, error out=w9)
        w8 = default
      }
      on "Optic Filter Config Button" Value changed {
        call "Enqueue Message (Single).gvi"(message queue in=w7, message="Optic Filter Config", message data=$"Optic Filter Selector") -> (message queue out=w10, error out=w9)
        w8 = default
      }
      on "Prepare CVM Button" Value changed {
        call "Enqueue Message (Single).gvi"(message queue in=w7, message="Prepare CVM") -> (message queue out=w10, error out=w9)
        w8 = default
      }
      on "Set Resistance Button" Value changed {
        call "Enqueue Message (Single).gvi"(message queue in=w7, message="Set Resistance", message data=$"Resistance String") -> (message queue out=w10, error out=w9)
        w8 = default
      }
      on "Reset Resistance Button" Value changed {
        call "Enqueue Message (Single).gvi"(message queue in=w7, message="Reset Resistance") -> (message queue out=w10, error out=w9)
        w8 = default
      }
      on "VAC Button" Value changed {
        Property Node(instance in=reference to "Graph_3")
        Get Current Time() -> (current time=w11)
        call "Enqueue Message (Single).gvi"(message queue in=w7, message="VAC", message data=w11) -> (message queue out=w10)
        $"VAC Load Counter" <- 0
        w8 = default
        w9 = default
      }
    }
    call "Error Handler - Event Handling Loop.gvi"(message queue in=w10, error in=w9) -> (dup error in=w12)
    stop if w8
  }
  Unregister For Events(error in=w12, event registration refnum=s1)
  w13 = T1 {"VISA Resource"="COM5", "Physical Channel"="", "tag"={"Path"="", "Datatype"="Double", "Configuration"={"Server URL"="", "Session"=0, "Raw Session Queue"=refnum}}, "configuration"={"Server URL"="", "Session"=0, "Raw Session Queue"=refnum}}
  s2 = "UI Data.gtype" {all zero or empty}  # shift register
  s3 = w13  # shift register
  while {
    call "Dequeue Message.gvi"(message queue in=w7, error in=w6) -> (message queue out=w14, message=w15, message data=w16, error out=w17)
    $"Maсhine State" <- w15
    # s2: Data
    # w3: Stop Event
    case (w15) ignore case {  # Message Cases
      frame "Initialize" {
        # set time
        #
        # NO initialase SLC
        call "Enqueue Message (Single).gvi"(message queue in=w14, message="Initialize VISA", error in=w17) -> (message queue out=w22, error out=w23)
        call "Enqueue Message (Single).gvi"(message queue in=w22, message="Initialize AI", error in=w23) -> (message queue out=w24, error out=w25)
        call "Enqueue Message (Single).gvi"(message queue in=w24, message="Set Time", error in=w25) -> (message queue out=w26, error out=w27)
        call "Enqueue Message (Single).gvi"(message queue in=w26, message="Reset CVM", error in=w27) -> (message queue out=w28, error out=w29)
        call "Enqueue Message (Single).gvi"(message queue in=w28, message="Fans Control", message data="Turn All Off", error in=w29) -> (message queue out=w30, error out=w31)
        call "Enqueue Message (Single).gvi"(message queue in=w30, message="Heat Config", message data="No Heat", error in=w31) -> (message queue out=w32, error out=w33)
        call "Enqueue Message (Single).gvi"(message queue in=w32, message="Optic Filter Config", message data="None", error in=w33) -> (message queue out=w34, error out=w35)
        call "Enqueue Message (Single).gvi"(message queue in=w34, message="Set PV Angle", message data=90, error in=w35) -> (message queue out=w36, error out=w37)
        call "Enqueue Message (Single).gvi"(message queue in=w36, message="PV Config", message data="Parallel 4", error in=w37) -> (message queue out=w38, error out=w39)
        call "Enqueue Message (Single).gvi"(message queue in=w38, message="Wait For Event", error in=w39) -> (error out=w18)
        w19 = s2
        w20 = default
        w21 = s3
      }
      frame "Wait For Event" {
        call "Enqueue Message (Single).gvi"(message queue in=w14, message="Watchdog", error in=w17) -> (error out=w18)
        w19 = s2
        w20 = default
        w21 = s3
      }
      frame "Initialize VISA" {
        call "Configure Serial Port (Instr).gvi"(stop bits="1.0"(10), session in=$"VISA Resource Name", baud rate=115200, parity="None"(0), termination char=0xA, enable termination char=TRUE) -> (session out=w40, error out=w41)
        call "Open (Instr).gvi"(resource name=w40, error in=w41) -> (session out=w42, error out=w43)
        Property Node(instance in=s3, "VISA Resource"=w42) -> (instance out=w21)
        Wait(time to wait=2000)
        Merge Errors(w43, w17) -> (error out=w18)
        w19 = s2
        w20 = default
      }
      frame "Initialize SLC" {
        call "Open Configuration API Key.gvi"(server url=$"Server Url", api key=$"Api Key") -> (configuration=w44, error out=w45)
        call "Open Tag.gvi"(path="PV_T", data type="String", error in=w45, configuration=w44) -> (tag=w46, error out=w47)
        Property Node(instance in=s3, "tag"=w46, "configuration"=w44) -> (instance out=w21)
        Wait(time to wait=2000)
        Merge Errors(w47, w17) -> (error out=w18)
        w19 = s2
        w20 = default
      }
      frame "Initialize AI" {
        call "DAQmx Create Channel (AI-Voltage-Basic).gvi"(physical channels="Dev1/ai0:1,Dev1/ai3,Dev1/ai7", units="Volts"(10348), measurement range="ValueRange.gtype" {"maximum value"=10, "minimum value"=0}, input terminal configuration="RSE"(10083)) -> (task out=w48, error out=w49)
        Property Node(instance in=s3, "Physical Channel"=w48) -> (instance out=w21)
        Merge Errors(w49, w17) -> (error out=w18)
        w19 = s2
        w20 = default
      }
      frame "Send CMD" {
        Property Node(instance in=s3) -> ("VISA Resource"=w50, instance out=w21)
        call "Read_Write_VISA.gvi"(VISA_IN=w50, CMD=$"write buffer", ERROR_IN=w17) -> (TAG=w51, ERROR_OUT=w52)
        $CMD <- w51
        call "Enqueue Message (Single).gvi"(message queue in=w14, message="Wait For Event", error in=w52) -> (error out=w18)
        w19 = s2
        w20 = default
      }
      frame "Set Time" {
        Property Node(instance in=s3) -> ("VISA Resource"=w53, instance out=w21)
        call "Read_Write_VISA.gvi"(VISA_IN=w53, CMD="@TIME 10 CEPHEI#", ERROR_IN=w17) -> (TAG=w54, ERROR_OUT=w55)
        $"CMD TIME" <- w54
        call "Enqueue Message (Single).gvi"(message queue in=w14, message="Wait For Event", error in=w55) -> (error out=w18)
        w19 = s2
        w20 = default
      }
      frame "PV Config" {
        Variant To Data(error in (no error)=w17, type=string "", variant=w16) -> (data=w56, error out=w57)
        Property Node(instance in=s3) -> ("VISA Resource"=w58, instance out=w21)
        call "PV_switch.gvi"(VISA_IN=w58, CTRL="Disconnect", ERROR_IN=w57) -> (VISA_OUT=w59, ERROR_OUT=w60)
        case (w56) {
          frame "Single", Default {
            w63 = ["@DO 17 0#", "@DO 18 1#", "@DO 23 1#", "@DO 24 1#", "@DO 25 1#", "@DO 26 0#", "@DO 27 0#", "@DO 28 0#", "@DO 29 1#", "@DO 30 1#", "@DO 31 1#", "@DO 32 1#", "@DO 33 0#"]
            w64 = ["@DO 54 1#", "@DO 55 1#", "@DO 56 1#", "@DO 57 1#", "@DO 58 1#", "@DO 59 1#", "@DO 60 1#", "@DO 61 1#"]
            # @DO 17 0#
            # @DO 18 1#
            # @DO 23 1#
            # @DO 24 1#
            # @DO 25 1#
            # @DO 26 0#
            # @DO 27 0#
            # @DO 28 0#
            # @DO 29 1#
            # @DO 30 1#
            # @DO 31 1#
            # @DO 32 1#
            # @DO 33 0#
            #
            # 03,08,2020
            # 19:51
            Insert Into Array(inArray=w63, new=w64) -> w65
            call "CMD_Iteration.gvi"(VISA_IN=w59, ARRAY_IN=w65, ERROR_IN=w60) -> (VISA Answer=w62, ERROR_OUT=w61)
          }
          frame "Parallel 2" {
            # @DO 17 1#
            # @DO 18 0#
            # @DO 23 1#
            # @DO 24 0#
            # @DO 25 1#
            # @DO 26 1#
            # @DO 27 1#
            # @DO 28 1#
            # @DO 29 1#
            # @DO 30 1#
            # @DO 31 1#
            # @DO 32 1#
            # @DO 33 1#
            #
            # 03.08.2020
            # 19.53
            w66 = ["@DO 17 1#", "@DO 18 0#", "@DO 23 1#", "@DO 24 0#", "@DO 25 1#", "@DO 26 1#", "@DO 27 1#", "@DO 28 1#", "@DO 29 1#", "@DO 30 1#", "@DO 31 1#", "@DO 32 1#", "@DO 33 1#"]
            # Disconnect all Diodes
            w67 = ["@DO 54 1#", "@DO 55 1#", "@DO 56 1#", "@DO 57 1#", "@DO 58 1#", "@DO 59 1#", "@DO 60 1#", "@DO 61 1#"]
            Insert Into Array(inArray=w66, new=w67) -> w68
            call "CMD_Iteration.gvi"(VISA_IN=w59, ARRAY_IN=w68, ERROR_IN=w60) -> (VISA Answer=w62, ERROR_OUT=w61)
          }
          frame "Parallel 2 Diode" {
            # @DO 17 1#
            # @DO 18 0#
            # @DO 23 1#
            # @DO 24 0#
            # @DO 25 1#
            # @DO 26 1#
            # @DO 27 1#
            # @DO 28 1#
            # @DO 29 1#
            # @DO 30 1#
            # @DO 31 1#
            # @DO 32 1#
            # @DO 33 1#
            #
            # 03.08.2020
            # 19.54
            w69 = ["@DO 17 1#", "@DO 18 0#", "@DO 23 1#", "@DO 24 0#", "@DO 25 1#", "@DO 26 1#", "@DO 27 1#", "@DO 28 1#", "@DO 29 1#", "@DO 30 1#", "@DO 31 1#", "@DO 32 1#", "@DO 33 1#"]
            # @DO 56 0#
            # @DO 57 0#
            #
            # 19.54
            w70 = ["@DO 54 1#", "@DO 55 1#", "@DO 56 0#", "@DO 57 0#", "@DO 58 1#", "@DO 59 1#", "@DO 60 1#", "@DO 61 1#"]
            Insert Into Array(inArray=w69, new=w70) -> w71
            call "CMD_Iteration.gvi"(VISA_IN=w59, ARRAY_IN=w71, ERROR_IN=w60) -> (VISA Answer=w62, ERROR_OUT=w61)
          }
          frame "Series 2" {
            # @DO 17 0#
            # @DO 18 1#
            # @DO 23 1#
            # @DO 24 0#
            # @DO 25 1#
            # @DO 26 1#
            # @DO 27 1#
            # @DO 28 1#
            # @DO 29 0#
            # @DO 30 1#
            # @DO 31 1#
            # @DO 32 0#
            # @DO 33 0#
            #
            # 03.08.2020
            # 19.55
            w72 = ["@DO 17 0#", "@DO 18 1#", "@DO 23 1#", "@DO 24 0#", "@DO 25 1#", "@DO 26 1#", "@DO 27 1#", "@DO 28 1#", "@DO 29 0#", "@DO 30 1#", "@DO 31 1#", "@DO 32 0#", "@DO 33 0#"]
            w73 = ["@DO 54 1#", "@DO 55 1#", "@DO 56 1#", "@DO 57 1#", "@DO 58 1#", "@DO 59 1#", "@DO 60 1#", "@DO 61 1#"]
            Insert Into Array(inArray=w72, new=w73) -> w74
            call "CMD_Iteration.gvi"(VISA_IN=w59, ARRAY_IN=w74, ERROR_IN=w60) -> (VISA Answer=w62, ERROR_OUT=w61)
          }
          frame "Series 2 Diode" {
            # @DO 17 0#
            # @DO 18 1#
            # @DO 23 1#
            # @DO 24 0#
            # @DO 25 1#
            # @DO 26 1#
            # @DO 27 1#
            # @DO 28 1#
            # @DO 29 0#
            # @DO 30 1#
            # @DO 31 1#
            # @DO 32 0#
            # @DO 33 0#
            #
            # 03.08.2020
            # 19.57
            w75 = ["@DO 17 0#", "@DO 18 1#", "@DO 23 1#", "@DO 24 0#", "@DO 25 1#", "@DO 26 1#", "@DO 27 1#", "@DO 28 1#", "@DO 29 0#", "@DO 30 1#", "@DO 31 1#", "@DO 32 0#", "@DO 33 0#"]
            # @DO 60 0#
            # @DO 61 0#
            #
            # 03.08.2020
            w76 = ["@DO 54 1#", "@DO 55 1#", "@DO 56 1#", "@DO 57 1#", "@DO 58 1#", "@DO 59 1#", "@DO 60 0#", "@DO 61 0#"]
            Insert Into Array(inArray=w75, new=w76) -> w77
            call "CMD_Iteration.gvi"(VISA_IN=w59, ARRAY_IN=w77, ERROR_IN=w60) -> (VISA Answer=w62, ERROR_OUT=w61)
          }
          frame "Parallel 4" {
            # @DO 17 1#
            # @DO 18 1#
            # @DO 23 1#
            # @DO 24 1#
            # @DO 25 1#
            # @DO 26 1#
            # @DO 27 1#
            # @DO 28 1#
            # @DO 29 1#
            # @DO 30 1#
            # @DO 31 1#
            # @DO 32 1#
            # @DO 33 1#
            #
            # 03.08.2020
            # 19.59
            w78 = ["@DO 17 1#", "@DO 18 1#", "@DO 23 1#", "@DO 24 1#", "@DO 25 1#", "@DO 26 1#", "@DO 27 1#", "@DO 28 1#", "@DO 29 1#", "@DO 30 1#", "@DO 31 1#", "@DO 32 1#", "@DO 33 1#"]
            w79 = ["@DO 54 1#", "@DO 55 1#", "@DO 56 1#", "@DO 57 1#", "@DO 58 1#", "@DO 59 1#", "@DO 60 1#", "@DO 61 1#"]
            Insert Into Array(inArray=w78, new=w79) -> w80
            call "CMD_Iteration.gvi"(VISA_IN=w59, ARRAY_IN=w80, ERROR_IN=w60) -> (VISA Answer=w62, ERROR_OUT=w61)
          }
          frame "Parallel 4 Diode" {
            # @DO 17 1#
            # @DO 18 1#
            # @DO 23 1#
            # @DO 24 1#
            # @DO 25 1#
            # @DO 26 1#
            # @DO 27 1#
            # @DO 28 1#
            # @DO 29 1#
            # @DO 30 1#
            # @DO 31 1#
            # @DO 32 1#
            # @DO 33 1#
            # 03.08.2020
            # 20.00
            w81 = ["@DO 17 1#", "@DO 18 1#", "@DO 23 1#", "@DO 24 1#", "@DO 25 1#", "@DO 26 1#", "@DO 27 1#", "@DO 28 1#", "@DO 29 1#", "@DO 30 1#", "@DO 31 1#", "@DO 32 1#", "@DO 33 1#"]
            # @DO 54 0#
            # @DO 55 0#
            # @DO 56 0#
            # @DO 57 0#
            #
            # 03.08.2020
            # 20.00
            w82 = ["@DO 54 0#", "@DO 55 0#", "@DO 56 0#", "@DO 57 0#", "@DO 58 1#", "@DO 59 1#", "@DO 60 1#", "@DO 61 1#"]
            Insert Into Array(inArray=w81, new=w82) -> w83
            call "CMD_Iteration.gvi"(VISA_IN=w59, ARRAY_IN=w83, ERROR_IN=w60) -> (VISA Answer=w62, ERROR_OUT=w61)
          }
          frame "Series 4" {
            # @DO 17 0#
            # @DO 18 1#
            # @DO 23 0#
            # @DO 24 1#
            # @DO 25 1#
            # @DO 26 0#
            # @DO 27 0#
            # @DO 28 0#
            # @DO 29 0#
            # @DO 30 0#
            # @DO 31 0#
            # @DO 32 0#
            # @DO 33 0#
            #
            # 03.08.2020
            # 20.02
            w84 = ["@DO 17 0#", "@DO 18 1#", "@DO 23 0#", "@DO 24 1#", "@DO 25 1#", "@DO 26 0#", "@DO 27 0#", "@DO 28 0#", "@DO 29 0#", "@DO 30 0#", "@DO 31 0#", "@DO 32 0#", "@DO 33 0#"]
            w85 = ["@DO 54 1#", "@DO 55 1#", "@DO 56 1#", "@DO 57 1#", "@DO 58 1#", "@DO 59 1#", "@DO 60 1#", "@DO 61 1#"]
            Insert Into Array(inArray=w84, new=w85) -> w86
            call "CMD_Iteration.gvi"(VISA_IN=w59, ARRAY_IN=w86, ERROR_IN=w60) -> (VISA Answer=w62, ERROR_OUT=w61)
          }
          frame "Series 4 Diode" {
            # @DO 17 0#
            # @DO 18 1#
            # @DO 23 0#
            # @DO 24 1#
            # @DO 25 1#
            # @DO 26 0#
            # @DO 27 0#
            # @DO 28 0#
            # @DO 29 0#
            # @DO 30 0#
            # @DO 31 0#
            # @DO 32 0#
            # @DO 33 0#
            #
            # 03.08.2020
            # 20.03
            w87 = ["@DO 17 0#", "@DO 18 1#", "@DO 23 0#", "@DO 24 1#", "@DO 25 1#", "@DO 26 0#", "@DO 27 0#", "@DO 28 0#", "@DO 29 0#", "@DO 30 0#", "@DO 31 0#", "@DO 32 0#", "@DO 33 0#"]
            # @DO 58 0#
            # @DO 59 0#
            # @DO 60 0#
            # @DO 61 0#
            #
            # 03.08.2020
            # 20.04
            w88 = ["@DO 54 1#", "@DO 55 1#", "@DO 56 1#", "@DO 57 1#", "@DO 58 0#", "@DO 59 0#", "@DO 60 0#", "@DO 61 0#"]
            Insert Into Array(inArray=w87, new=w88) -> w89
            call "CMD_Iteration.gvi"(VISA_IN=w59, ARRAY_IN=w89, ERROR_IN=w60) -> (VISA Answer=w62, ERROR_OUT=w61)
          }
          frame "Parallel Of Series" {
            # @DO 17 1#
            # @DO 18 1#
            # @DO 23 1#
            # @DO 24 1#
            # @DO 25 1#
            # @DO 26 1#
            # @DO 27 0#
            # @DO 28 1#
            # @DO 29 0#
            # @DO 30 0#
            # @DO 31 1#
            # @DO 32 0#
            # @DO 33 1#
            #
            # 03.08.2020
            # 20.05
            w90 = ["@DO 17 1#", "@DO 18 1#", "@DO 23 1#", "@DO 24 1#", "@DO 25 1#", "@DO 26 1#", "@DO 27 0#", "@DO 28 1#", "@DO 29 0#", "@DO 30 0#", "@DO 31 1#", "@DO 32 0#", "@DO 33 1#"]
            w91 = ["@DO 54 1#", "@DO 55 1#", "@DO 56 1#", "@DO 57 1#", "@DO 58 1#", "@DO 59 1#", "@DO 60 1#", "@DO 61 1#"]
            Insert Into Array(inArray=w90, new=w91) -> w92
            call "CMD_Iteration.gvi"(VISA_IN=w59, ARRAY_IN=w92, ERROR_IN=w60) -> (VISA Answer=w62, ERROR_OUT=w61)
          }
          frame "Parallel Of Series Diode" {
            # @DO 17 1#
            # @DO 18 1#
            # @DO 23 1#
            # @DO 24 1#
            # @DO 25 1#
            # @DO 26 1#
            # @DO 27 0#
            # @DO 28 1#
            # @DO 29 0#
            # @DO 30 0#
            # @DO 31 1#
            # @DO 32 0#
            # @DO 33 1#
            #
            # 03.08.2020
            # 20.06
            # @DO 58 0#
            # @DO 59 0#
            # @DO 60 0#
            # @DO 61 0#
            #
            # 03.08.2020
            # 20.097
            w93 = ["@DO 17 1#", "@DO 18 1#", "@DO 23 1#", "@DO 24 1#", "@DO 25 1#", "@DO 26 1#", "@DO 27 0#", "@DO 28 1#", "@DO 29 0#", "@DO 30 0#", "@DO 31 1#", "@DO 32 0#", "@DO 33 1#"]
            w94 = ["@DO 54 1#", "@DO 55 1#", "@DO 56 1#", "@DO 57 1#", "@DO 58 0#", "@DO 59 0#", "@DO 60 0#", "@DO 61 0#"]
            Insert Into Array(inArray=w93, new=w94) -> w95
            call "CMD_Iteration.gvi"(VISA_IN=w59, ARRAY_IN=w95, ERROR_IN=w60) -> (VISA Answer=w62, ERROR_OUT=w61)
          }
          frame "Series Of Parallel" {
            w96 = ["@DO 54 1#", "@DO 55 1#", "@DO 56 1#", "@DO 57 1#", "@DO 58 1#", "@DO 59 1#", "@DO 60 1#", "@DO 61 1#"]
            # @DO 17 1#
            # @DO 18 0#
            # @DO 23 0#
            # @DO 24 0#
            # @DO 25 0#
            # @DO 26 1#
            # @DO 27 1#
            # @DO 28 1#
            # @DO 29 1#
            # @DO 30 1#
            # @DO 31 1#
            # @DO 32 1#
            # @DO 33 1#
            #
            # 03.08.2020
            # 20.07
            w97 = ["@DO 17 1#", "@DO 18 0#", "@DO 23 0#", "@DO 24 0#", "@DO 25 0#", "@DO 26 1#", "@DO 27 1#", "@DO 28 1#", "@DO 29 1#", "@DO 30 1#", "@DO 31 1#", "@DO 32 1#", "@DO 33 1#"]
            Insert Into Array(inArray=w97, new=w96) -> w98
            call "CMD_Iteration.gvi"(VISA_IN=w59, ARRAY_IN=w98, ERROR_IN=w60) -> (VISA Answer=w62, ERROR_OUT=w61)
          }
          frame "Series Of Parallel Diode" {
            # @DO 17 1#
            # @DO 18 0#
            # @DO 23 0#
            # @DO 24 0#
            # @DO 25 0#
            # @DO 26 1#
            # @DO 27 1#
            # @DO 28 1#
            # @DO 29 1#
            # @DO 30 1#
            # @DO 31 1#
            # @DO 32 1#
            # @DO 33 1#
            #
            # 03.08.2020
            # 20.08
            w99 = ["@DO 17 1#", "@DO 18 0#", "@DO 23 0#", "@DO 24 0#", "@DO 25 0#", "@DO 26 1#", "@DO 27 1#", "@DO 28 1#", "@DO 29 1#", "@DO 30 1#", "@DO 31 1#", "@DO 32 1#", "@DO 33 1#"]
            # @DO 54 0#
            # @DO 55 0#
            # @DO 56 0#
            # @DO 57 0#
            #
            # 20.09
            # 03.08.2020
            w100 = ["@DO 54 0#", "@DO 55 0#", "@DO 56 0#", "@DO 57 0#", "@DO 58 1#", "@DO 59 1#", "@DO 60 1#", "@DO 61 1#"]
            Insert Into Array(inArray=w99, new=w100) -> w101
            call "CMD_Iteration.gvi"(VISA_IN=w59, ARRAY_IN=w101, ERROR_IN=w60) -> (VISA Answer=w62, ERROR_OUT=w61)
          }
        }
        call "PV_switch.gvi"(VISA_IN=w58, CTRL="Connect", ERROR_IN=w61) -> (ERROR_OUT=w18)
        case (w18) {
          frame Error, Default { }
          frame No Error {
            $"Status PV Config" <- w56
            Property Node(instance in=reference to "PV-Connecting Solar Panels", "ValueSignaling"=w56)
          }
        }
        $"VISA Answer" <- w62
        w19 = s2
        w20 = default
      }
      frame "Reset CVM" {
        Property Node(instance in=s3) -> ("VISA Resource"=w102, instance out=w21)
        # VOLTAGE RANGE
        # @DO 51 0#
        # @DO 52 0#
        # @DO 53 0#
        # CURRENT RANGE
        # @DO 50 1#
        call "CMD_Iteration.gvi"(VISA_IN=w102, ARRAY_IN=["@DO 51 1#", "@DO 52 1#", "@DO 53 1#"], ERROR_IN=w17) -> (VISA_OUT=w103, ERROR_OUT=w104)
        call "CMD_Iteration.gvi"(VISA_IN=w103, ARRAY_IN=["@DO 50 1#"], ERROR_IN=w104) -> (ERROR_OUT=w18)
        $"Voltage coeff" <- 1
        $"Current coeff" <- 1
        w19 = s2
        w20 = default
      }
      frame "VAC" {
        w105 = ["0", "1,", "10,", "20,10,", "50,", "50,20,", "100,", "100,40,10,", "200,100,", "500,100,", "1000,", "2000,", "2000,1000,", "4000,", "4000,1000,", "4000,2000,", "4000,2000,1000,", "4000,2000,1000,500,400,100,"]
        Array Size(array=w105) -> (size(s)=w106)
        Is Less Or Equal(x=$"VAC Load Counter", y=w106) -> w107
        Property Node(instance in=s3) -> ("VISA Resource"=w108, "Physical Channel"=w109, instance out=w21)
        Variant To Data(type=timestamp 1904-01-01T00:00:00Z, variant=w16) -> (data=w110)
        Get Current Time() -> (current time=w111)
        Timestamp Subtract(x=w111, y=w110) -> w112
        Is Greater Or Equal(x=w112, y=5) -> w113
        Logical And(w113, w107) -> w114
        call "DAQmx Read (Analog 2D DBL NChan NSamp).gvi"(task in=w109, number of samples per channel=1) -> (data=w115)
        Array Index(array=w115) -> (out0[1, 0]=w116)
        Multiply(w116, 4) -> w117
        Feedback Node(input=w118) -> w119
        Build Array(w119, w117) -> w118
        Array Index(array=w115) -> (out0[0, 0]=w120)
        Divide(x=w120, y=70) -> w121
        Multiply(w121, 1000) -> w122
        Feedback Node(input=w123) -> w124
        Build Array(w124, w122) -> w123
        Build Cluster(w118, w123) -> w125
        case (w114) {
          frame False, Default {
            w126 = w17
            w127 = w110
            w128 = $"VAC Load Counter"
          }
          frame True {
            Get Current Time() -> (current time=w127)
            # Disconnect ALL load
            Array Index(array=w105) -> (out0[$"VAC Load Counter"]=w129)
            w130 = ["@DO 42 1#", "@DO 34 0#", "@DO 35 0#", "@DO 36 0#", "@DO 37 0#", "@DO 38 0#", "@DO 39 0#", "@DO 40 0#", "@DO 41 0#", "@DO 43 0#", "@DO 44 0#", "@DO 45 0#", "@DO 46 0#", "@DO 47 0#", "@DO 48 0#", "@DO 49 0#"]
            call "CMD_Iteration.gvi"(VISA_IN=w108, ARRAY_IN=w130, ERROR_IN=w17) -> (ERROR_OUT=w131)
            s4 = w129  # shift register
            while {
              Match Pattern(regular expression=",", string=s4) -> (after substring=w132, before substring=w133)
              case (w133) {
                frame "1", Default {
                  call "Read_Write_VISA.gvi"(VISA_IN=w108, CMD="@DO 43 1#", ERROR_IN=w131) -> (ERROR_OUT=w134)
                }
                frame "2" {
                  call "Read_Write_VISA.gvi"(VISA_IN=w108, CMD="@DO 44 1#", ERROR_IN=w131) -> (ERROR_OUT=w134)
                }
                frame "3" {
                  call "Read_Write_VISA.gvi"(VISA_IN=w108, CMD="@DO 45 1#", ERROR_IN=w131) -> (ERROR_OUT=w134)
                }
                frame "5" {
                  call "Read_Write_VISA.gvi"(VISA_IN=w108, CMD="@DO 46 1#", ERROR_IN=w131) -> (ERROR_OUT=w134)
                }
                frame "10" {
                  call "Read_Write_VISA.gvi"(VISA_IN=w108, CMD="@DO 47 1#", ERROR_IN=w131) -> (ERROR_OUT=w134)
                }
                frame "20" {
                  call "Read_Write_VISA.gvi"(VISA_IN=w108, CMD="@DO 48 1#", ERROR_IN=w131) -> (ERROR_OUT=w134)
                }
                frame "40" {
                  call "Read_Write_VISA.gvi"(VISA_IN=w108, CMD="@DO 49 1#", ERROR_IN=w131) -> (ERROR_OUT=w134)
                }
                frame "50" {
                  call "Read_Write_VISA.gvi"(VISA_IN=w108, CMD="@DO 34 1#", ERROR_IN=w131) -> (ERROR_OUT=w134)
                }
                frame "100" {
                  call "Read_Write_VISA.gvi"(VISA_IN=w108, CMD="@DO 35 1#", ERROR_IN=w131) -> (ERROR_OUT=w134)
                }
                frame "200" {
                  call "Read_Write_VISA.gvi"(VISA_IN=w108, CMD="@DO 36 1#", ERROR_IN=w131) -> (ERROR_OUT=w134)
                }
                frame "400" {
                  call "Read_Write_VISA.gvi"(VISA_IN=w108, CMD="@DO 37 1#", ERROR_IN=w131) -> (ERROR_OUT=w134)
                }
                frame "500" {
                  call "Read_Write_VISA.gvi"(VISA_IN=w108, CMD="@DO 38 1#", ERROR_IN=w131) -> (ERROR_OUT=w134)
                }
                frame "1000" {
                  call "Read_Write_VISA.gvi"(VISA_IN=w108, CMD="@DO 39 1#", ERROR_IN=w131) -> (ERROR_OUT=w134)
                }
                frame "2000" {
                  call "Read_Write_VISA.gvi"(VISA_IN=w108, CMD="@DO 40 1#", ERROR_IN=w131) -> (ERROR_OUT=w134)
                }
                frame "4000" {
                  call "Read_Write_VISA.gvi"(VISA_IN=w108, CMD="@DO 41 1#", ERROR_IN=w131) -> (ERROR_OUT=w134)
                }
                frame "0" {
                  # Для измерения тока К.З.
                  # Схема сопротивления
                  # 1 Ом + 1 Ом токовый резистор
                  w134 = w131
                }
              }
              Is Empty String Or Path(string/path=w132) -> w135
              next s4 = w132
              stop if w135
            }
            call "Read_Write_VISA.gvi"(VISA_IN=w108, CMD="@DO 42 0#", ERROR_IN=w134) -> (ERROR_OUT=w126)
            Increment(x=$"VAC Load Counter") -> w128
            $Graph_3 <- w125
          }
        }
        call "Enqueue Message (Single).gvi"(message queue in=w14, message="Watchdog", error in=w126) -> (error out=w136)
        case (w107) {
          frame False, Default {
            w18 = w136
          }
          frame True {
            call "Enqueue Message (Single).gvi"(message queue in=w14, message="VAC", message data=w127, error in=w136) -> (error out=w18)
          }
        }
        $"VAC Load Counter" <- w128
        w19 = s2
        w20 = default
      }
      frame "Prepare CVM" {
        Property Node(instance in=s3) -> ("VISA Resource"=w137, "Physical Channel"=w138, instance out=w21)
        call "DAQmx Read (Analog 2D DBL NChan NSamp).gvi"(task in=w138, error in=w17, number of samples per channel=1) -> (error out=w139, data=w140)
        Array Index(array=w140) -> (out0[2, 0]=w141)
        Multiply(w141, 4) -> w142
        C Code Node("x"=w142) -> ("y"=w143, Error Out=w144)
        ~~~
        if(x>-1 && x<=1)
          y = 0;
        if(x>1 && x<=10)
          y = 1;
        if(x>10 && x<=20)
          y = 2;
        if(x>20 && x<=30)
          y = 3;
        ~~~
        $"Voltage Range" <- w143
        # Voltage Range
        case (w143) {
          frame 0, Default {
            call "CMD_Iteration.gvi"(VISA_IN=w137, ARRAY_IN=["@DO 51 1#", "@DO 52 1#", "@DO 53 0#"], ERROR_IN=w144) -> (VISA Answer=w147, ERROR_OUT=w145)
            w146 = 0.1
          }
          frame 1 {
            call "CMD_Iteration.gvi"(VISA_IN=w137, ARRAY_IN=["@DO 51 1#", "@DO 52 1#", "@DO 53 1#"], ERROR_IN=w144) -> (VISA Answer=w147, ERROR_OUT=w145)
            w146 = 1
          }
          frame 2 {
            call "CMD_Iteration.gvi"(VISA_IN=w137, ARRAY_IN=["@DO 51 1#", "@DO 52 0#", "@DO 53 1#"], ERROR_IN=w144) -> (VISA Answer=w147, ERROR_OUT=w145)
            w146 = 0.5
          }
          frame 3 {
            # Div x0.25 works with 2 relay
            call "CMD_Iteration.gvi"(VISA_IN=w137, ARRAY_IN=["@DO 51 0#\n"], ERROR_IN=w144) -> (VISA Answer=w147, ERROR_OUT=w145)
            w146 = 0.25
          }
        }
        $"Voltage coeff" <- w146
        $"VISA Answer_2" <- w147
        Array Index(array=w140) -> (out0[3, 0]=w148)
        # Tip For Local Wiring Solution
        # Relay 1(50) 	DO 1- REP A x1
        # 		DO 0- AMP A x10
        #
        # Relay 2(51) 	DO 1-REP V x1
        # 		DO 0-DIV V x0.25
        # Relay 3(52) 	DO 1-REP V x1
        # 		DO 0-DIV V x0.5
        # Relay 4(53) 	DO 1-REP V x1
        # 		DO 0-AMP V x10
        C Code Node("x"=w148) -> ("y"=w149)
        ~~~
        if(x>-1 && x<=0.6)
          y = 0;
        if(x>0.6 && x<=6)
          y = 1;
        ~~~
        # Current Range
        case (w149) {
          frame 0, Default {
            call "CMD_Iteration.gvi"(VISA_IN=w137, ARRAY_IN=["@DO 50 0#"]) -> (ERROR_OUT=w150)
            w151 = 0.1
          }
          frame 1 {
            call "CMD_Iteration.gvi"(VISA_IN=w137, ARRAY_IN=["@DO 50 1#"]) -> (ERROR_OUT=w150)
            w151 = 1
          }
        }
        $"Current coeff" <- w151
        Merge Errors(w145, w150, w139) -> (error out=w18)
        w19 = s2
        w20 = default
      }
      frame "Fans Control" {
        Property Node(instance in=s3) -> ("VISA Resource"=w152, instance out=w21)
        Variant To Data(error in (no error)=w17, type=string "", variant=w16) -> (data=w153, error out=w154)
        case (w153) {
          frame "Turn All Off", Default {
            w155 = ["@DO 7 0#", "@DO 8 0#"]
          }
          frame "Turn All On" {
            w155 = ["@DO 7 1#", "@DO 8 1#"]
          }
          frame "Turn 1,2 On" {
            w155 = ["@DO 7 1#", "@DO 8 0#", ""]
          }
          frame "Turn 3,4 On" {
            w155 = ["@DO 8 1#", "@DO 7 0#"]
          }
        }
        call "CMD_Iteration.gvi"(VISA_IN=w152, ARRAY_IN=w155, ERROR_IN=w154) -> (ERROR_OUT=w18)
        w19 = s2
        w20 = default
      }
      frame "Heat Config" {
        Property Node(instance in=s3) -> ("VISA Resource"=w156, instance out=w21)
        Variant To Data(error in (no error)=w17, type=string "", variant=w16) -> (data=w157, error out=w158)
        case (w157) {
          frame "No Heat", Default {
            w159 = ["@PWM 9 0#"]
          }
          frame "50 Heat" {
            w159 = ["@PWM 9 125#"]
          }
          frame "100 Heat" {
            w159 = ["@PWM 9 255#"]
          }
        }
        call "CMD_Iteration.gvi"(VISA_IN=w156, ARRAY_IN=w159, ERROR_IN=w158) -> (ERROR_OUT=w18)
        w19 = s2
        w20 = default
      }
      frame "Optic Filter Config" {
        Property Node(instance in=s3) -> ("VISA Resource"=w160, instance out=w21)
        Variant To Data(error in (no error)=w17, type=string "", variant=w16) -> (data=w161, error out=w162)
        case (w161) {
          frame "None", Default {
            w163 = ["@SERV 3 90#", "@SERV 4 0#"]
          }
          frame "Filter 1" {
            w163 = ["@SERV 3 90#", "@SERV 4 0#", "@SERV 3 0#"]
          }
          frame "Filter 2" {
            w163 = ["@SERV 3 90#", "@SERV 4 0#", "@SERV 4 90#"]
          }
        }
        call "CMD_Iteration.gvi"(VISA_IN=w160, ARRAY_IN=w163, ERROR_IN=w162) -> (ERROR_OUT=w18)
        w19 = s2
        w20 = default
      }
      frame "Set PV Angle" {
        Property Node(instance in=s3) -> ("VISA Resource"=w164, instance out=w21)
        Variant To Data(error in (no error)=w17, type=u32 0, variant=w16) -> (data=w165, error out=w166)
        # Set angle limits for PV panels
        In Range And Coerce(lower limit=0, upper limit=180, x=w165) -> (coerced(x)=w167)
        Number To Decimal String(number=w167) -> (decimal integer string=w168)
        Concatenate Strings("@SERV 13 ", w168, " #") -> w169
        call "Read_Write_VISA.gvi"(VISA_IN=w164, CMD=w169, ERROR_IN=w166) -> (ERROR_OUT=w18)
        w19 = s2
        w20 = default
      }
      frame "Brightness Config" {
        Property Node(instance in=s3) -> ("VISA Resource"=w170, instance out=w21)
        Variant To Data(error in (no error)=w17, type=u32 0, variant=w16) -> (data=w171, error out=w172)
        # Set brightness limits
        In Range And Coerce(lower limit=0, upper limit=100, x=w171) -> (coerced(x)=w173)
        Number To Decimal String(number=w173) -> (decimal integer string=w174)
        Concatenate Strings("@DIM 6 ", w174, " #") -> w175
        call "Read_Write_VISA.gvi"(VISA_IN=w170, CMD=w175, ERROR_IN=w172) -> (ERROR_OUT=w18)
        w19 = s2
        w20 = default
      }
      frame "IR Thermometer" {
        Property Node(instance in=s3) -> ("VISA Resource"=w176, instance out=w21)
        Variant To Data(error in (no error)=w17, type=string "", variant=w16) -> (data=w177, error out=w178)
        case (w177) {
          frame "None", Default {
            w179 = "@SERV 5 0#"
          }
          frame "Panel 1" {
            w179 = "@SERV 5 50#"
          }
          frame "Panel 2" {
            w179 = "@SERV 5 90#"
          }
          frame "Panel 3" {
            w179 = "@SERV 5 120#"
          }
          frame "Panel 4" {
            w179 = "@SERV 5 150#"
          }
        }
        call "Read_Write_VISA.gvi"(VISA_IN=w176, CMD=w179, ERROR_IN=w178) -> (ERROR_OUT=w18)
        w19 = s2
        w20 = default
      }
      frame "Set Resistance" {
        Property Node(instance in=s3) -> ("VISA Resource"=w180, instance out=w21)
        Variant To Data(error in (no error)=w17, type=string "", variant=w16) -> (data=w181, error out=w182)
        # Disconnect ALL load
        w183 = ["@DO 42 1#", "@DO 34 0#", "@DO 35 0#", "@DO 36 0#", "@DO 37 0#", "@DO 38 0#", "@DO 39 0#", "@DO 40 0#", "@DO 41 0#", "@DO 43 0#", "@DO 44 0#", "@DO 45 0#", "@DO 46 0#", "@DO 47 0#", "@DO 48 0#", "@DO 49 0#"]
        call "CMD_Iteration.gvi"(VISA_IN=w180, ARRAY_IN=w183, ERROR_IN=w182) -> (VISA_OUT=w184, ERROR_OUT=w185)
        s5 = w181  # shift register
        while {
          Match Pattern(regular expression=",", string=s5) -> (after substring=w186, before substring=w187)
          case (w187) {
            frame "1", Default {
              call "Read_Write_VISA.gvi"(VISA_IN=w184, CMD="@DO 43 1#", ERROR_IN=w185) -> (ERROR_OUT=w188)
            }
            frame "2" {
              call "Read_Write_VISA.gvi"(VISA_IN=w184, CMD="@DO 44 1#", ERROR_IN=w185) -> (ERROR_OUT=w188)
            }
            frame "3" {
              call "Read_Write_VISA.gvi"(VISA_IN=w184, CMD="@DO 45 1#", ERROR_IN=w185) -> (ERROR_OUT=w188)
            }
            frame "5" {
              call "Read_Write_VISA.gvi"(VISA_IN=w184, CMD="@DO 46 1#", ERROR_IN=w185) -> (ERROR_OUT=w188)
            }
            frame "10" {
              call "Read_Write_VISA.gvi"(VISA_IN=w184, CMD="@DO 47 1#", ERROR_IN=w185) -> (ERROR_OUT=w188)
            }
            frame "20" {
              call "Read_Write_VISA.gvi"(VISA_IN=w184, CMD="@DO 48 1#", ERROR_IN=w185) -> (ERROR_OUT=w188)
            }
            frame "40" {
              call "Read_Write_VISA.gvi"(VISA_IN=w184, CMD="@DO 49 1#", ERROR_IN=w185) -> (ERROR_OUT=w188)
            }
            frame "50" {
              call "Read_Write_VISA.gvi"(VISA_IN=w184, CMD="@DO 34 1#", ERROR_IN=w185) -> (ERROR_OUT=w188)
            }
            frame "100" {
              call "Read_Write_VISA.gvi"(VISA_IN=w184, CMD="@DO 35 1#", ERROR_IN=w185) -> (ERROR_OUT=w188)
            }
            frame "200" {
              call "Read_Write_VISA.gvi"(VISA_IN=w184, CMD="@DO 36 1#", ERROR_IN=w185) -> (ERROR_OUT=w188)
            }
            frame "400" {
              call "Read_Write_VISA.gvi"(VISA_IN=w184, CMD="@DO 37 1#", ERROR_IN=w185) -> (ERROR_OUT=w188)
            }
            frame "500" {
              call "Read_Write_VISA.gvi"(VISA_IN=w184, CMD="@DO 38 1#", ERROR_IN=w185) -> (ERROR_OUT=w188)
            }
            frame "1000" {
              call "Read_Write_VISA.gvi"(VISA_IN=w184, CMD="@DO 39 1#", ERROR_IN=w185) -> (ERROR_OUT=w188)
            }
            frame "2000" {
              call "Read_Write_VISA.gvi"(VISA_IN=w184, CMD="@DO 40 1#", ERROR_IN=w185) -> (ERROR_OUT=w188)
            }
            frame "4000" {
              call "Read_Write_VISA.gvi"(VISA_IN=w184, CMD="@DO 41 1#", ERROR_IN=w185) -> (ERROR_OUT=w188)
            }
            frame "0" {
              # Для измерения тока К.З.
              # Схема сопротивления
              # 1 Ом + 1 Ом токовый резистор
              w188 = w185
            }
          }
          Is Empty String Or Path(string/path=w186) -> w189
          next s5 = w186
          stop if w189
        }
        # Connect Load
        call "Read_Write_VISA.gvi"(VISA_IN=w180, CMD="@DO 42 0#", ERROR_IN=w188) -> (ERROR_OUT=w18)
        w19 = s2
        w20 = default
      }
      frame "Reset Resistance" {
        Property Node(instance in=s3) -> ("VISA Resource"=w190, instance out=w21)
        # Размыкаются всё реле, сопротивление- бесконечность
        w191 = ["@DO 42 1#", "@DO 34 1#", "@DO 35 1#", "@DO 36 1#", "@DO 37 1#", "@DO 38 1#", "@DO 39 1#", "@DO 40 1#", "@DO 41 1#", "@DO 43 1#", "@DO 44 1#", "@DO 45 1#", "@DO 46 1#", "@DO 47 1#", "@DO 48 1#", "@DO 49 1#"]
        # Сопротивление в начальное положение
        call "CMD_Iteration.gvi"(VISA_IN=w190, ARRAY_IN=w191, ERROR_IN=w17) -> (ERROR_OUT=w18)
        w19 = s2
        w20 = default
      }
      frame "Watchdog" {
        Property Node(instance in=s3) -> ("Physical Channel"=w192, "VISA Resource"=w193, instance out=w21)
        call "DAQmx Read (Analog 2D DBL NChan NSamp).gvi"(task in=w192, number of samples per channel=1) -> (data=w194)
        Array Index(array=w194) -> (out0[1, 0]=w195)
        Multiply(w195, 4) -> w196
        Multiply(w196, $"Voltage coeff") -> w197
        Feedback Node(input=w198) -> w199
        Build Array(w199, w197) -> w198
        $Voltage_Graph <- w198
        $V_real <- w197
        Array Index(array=w194) -> (out0[0, 0]=w200)
        Divide(x=w200, y=70) -> w201
        Multiply(w201, 1000) -> w202
        Multiply(w202, $"Current coeff") -> w203
        $Current_real <- w203
        call "Read_Write_VISA.gvi"(VISA_IN=w193, CMD="@LUX 10 1#", ERROR_IN=w17) -> (OUTPUT=w204, TAG=w205, ERROR_OUT=w206)
        $LUX_2 <- w205
        call "Read_Write_VISA.gvi"(VISA_IN=w204, CMD="@TEMP 12 0#", ERROR_IN=w206) -> (TAG=w207, ERROR_OUT=w208)
        $TEMP_2 <- w207
        call "DAQmx Read (Analog 1D Wfm NChan NSamp).gvi"(task in=w192, error in=w208, number of samples per channel=1) -> (error out=w209, data=w210)
        $Chart <- w210
        Feedback Node(input=w211) -> w212
        Build Array(w212, w203) -> w211
        $Current_Graph <- w211
        call "Enqueue Message (Single).gvi"(message queue in=w14, message="Wait For Event", error in=w209) -> (error out=w18)
        w19 = s2
        w20 = default
      }
      frame "Error" {
        Variant To Data(error in (no error)=w17, type=no error, variant=w16) -> (data=w213, error out=w18)
        # #CodeRecommended - If you ever change the name of this "Error" message, you'll need to update the name in the Check Loop Error.vi as well.
        call "Display Error.gvi"(error in=w213)
        w19 = s2
        w20 = default
        w21 = s3
      }
      frame "Exit" {
        Generate User Event(event data=TRUE, user event=w3) -> (error out=w214)
        Release Queue(error in=w17, queue=w14) -> (error out=w215)
        Property Node(instance in=s3) -> ("VISA Resource"=w216, "Physical Channel"=w217, "tag"=w218, "configuration"=w219)
        call "Close Configuration.gvi"(configuration=w219) -> (error out=w220)
        call "Close Tag (Single).gvi"(tag=w218, error in=w220) -> (error out=w221)
        call "DAQmx Stop Task.gvi"(task in=w217, error in=w221) -> (error out=w222)
        call "Close (Instr).gvi"(session in=w216, error in=w222) -> (error out=w223)
        Merge Errors(w223, w214, w215) -> (error out=w18)
        w19 = s2
        w20 = TRUE
        w21 = default
      }
      frame Default {
        w224 = "The invalid message string \"%s\" was received in the Message Handling Loop."
        Format Into String(formatString=w224, w15) -> w225
        call "Build Error Cluster.gvi"(code=1, description=w225) -> (error out=w18)
        w19 = s2
        w20 = default
        w21 = s3
      }
    }
    call "Error Handler - Message Handling Loop.gvi"(message queue in=w14, error in=w18) -> (dup error in=w226)
    $Output <- w18
    next s2 = w19
    next s3 = w21
    stop if w20
  }
  disable {
    frame Enabled { }
    frame Disabled {
      call "Initialize.gvi"(device name="cam0") -> (session out=w227, error out=w228)
      call "Configure Grab.gvi"(session in=w227, error in=w228) -> (session out=w229, error out=w230)
      call "Create Image.gvi"(image name="image_1") -> (new image=w231)
      while {
        call "Grab.gvi"(session in=w229, error in=w230, image in=w231) -> (session out=w232, error out=w233, image out=w234)
        $Image <- w234
        stop if $Stop
      }
      call "Close.gvi"(session=w232, error in=w233)
    }
  }
